# Grasshopper definition Hib_C_Ravenna.ghx (Grasshopper 1.0.8)
# plug-ins: Pufferfish

# ----
# ============================================================
#            INSTRUCTIVO: HERRAJES HÍBRIDOS (3BF)
# ============================================================
# 
# 1. CARGAR MALLAS
# • Introduce en el componente "Mesh" inicial todas las mallas
#   revueltas de los diferentes herrajes (sin internalizar).
# 
# 2. FLUJO AL PYTHON
# • Conecta el "Mesh" al nodo "Guid".
# • Conecta el "Guid" a la entrada [M] del componente Python.
# • Por [out] (panel amarillo) saldrán los nombres con su ID.
# 
# 3. CONEXIÓN E INTERNALIZACIÓN
# • Conecta la salida [Mallas] al componente de geometría
#   "RH_OUT:Herrajes".
# • Clic derecho en "RH_OUT:Herrajes" -> "Internalise data".
#   (Se desconectará automáticamente: significa que ya tiene
#   toda la información en su interior).
# 
# 4. GUARDAR
# • Guarda el archivo (.ghx). 3dBimFab ya leerá los herrajes
#   con sus nombres y cantidades exactas.
# ============================================================
mesh = Mesh([<mesh referenced from the Rhino model> x48])
guid = Guid(mesh)
python_3_script = Python3Script(M=guid)  # -> out, Mallas; inputs M: list
# ---------- python_3_script: Python ----------
"""
==============================================================================
3BF DfMA Herrajes Híbridos - Inyector de UserStrings
==============================================================================
Nombre:        3bf_hardware_injector.py
Versión:       v1.0.0
Autor:         Mario Mojica
Ecosistema:    3dBimFab (3BF)
Fecha:         Octubre 2026

DESCRIPCIÓN:
    Extrae mallas de herrajes referenciadas desde el documento activo de Rhino
    a través de sus identificadores GUID, captura el nombre real asignado a cada 
    objeto en Rhino (Name) y lo inyecta permanentemente como metadato 
    UserString ("Name") en la geometría OpenNURBS de la malla.
    
    Esto permite congelar/internalizar los herrajes dentro de un nodo 
    'RH_OUT:Herrajes' para que RhinoCompute y el worker 3BF reconozcan 
    automáticamente los nombres de herrajes (patas, tornillos, cantoneras, etc.)
    en modo headless sin requerir el archivo 3dm abierto.

ENTRADAS:
    M (List Access): Lista de GUIDs provenientes del contenedor 'Guid' de GH.

SALIDAS:
    Mallas: Lista de mallas con UserString "Name" inyectado.
    out:    Reporte diagnóstico de nombres y conteos detectados.
==============================================================================
"""

import Rhino
import System

mallas_list = []
log = []

if M:
    for item in M:
        # Extraer el Guid nativo (.NET System.Guid)
        guid_str = str(getattr(item, 'Value', item))
        try:
            guid_val = System.Guid(guid_str)
        except Exception:
            continue
        
        # Localizar el objeto en el documento activo de Rhino
        rh_obj = Rhino.RhinoDoc.ActiveDoc.Objects.FindId(guid_val)
        if rh_obj is not None:
            nombre = rh_obj.Name if rh_obj.Name else "Herraje"
            geom = rh_obj.Geometry
            
            # Si es Mesh, duplicar e inyectar el UserString
            if isinstance(geom, Rhino.Geometry.Mesh):
                m_copy = geom.DuplicateMesh()
                m_copy.SetUserString("Name", nombre)
                mallas_list.append(m_copy)
                log.append("{}: {}".format(nombre, guid_val))

# Salidas de Grasshopper
Mallas = mallas_list
print("=== 3BF Herrajes: {} procesados ===".format(len(mallas_list)))
for l in log:
    print(l)
# ---------- end python_3_script ----------
panel = Panel(python_3_script.out)
rh_out_herrajes = Geometry([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])

brep = Brep(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)
brep_2 = Brep([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])
brep_3 = Brep([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])
brep_4 = Brep(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)
brep_5 = Brep([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])
brep_6 = Brep(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)
brep_7 = Brep([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])
brep_8 = Brep([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])
brep_9 = Brep([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])
brep_10 = Brep(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)
brep_11 = Brep([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])
brep_12 = Brep(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)
brep_13 = Brep(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)
brep_14 = Brep(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)
brep_15 = Brep(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)
brep_16 = Brep(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)
brep_17 = Brep(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)
brep_18 = Brep(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)
brep_19 = Brep(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)
brep_20 = Brep(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)

# ---- group: Zocalo Frontal
rh_in_03_1_lado_balance = ValueList({"Cara A", "Cara B", "D/D"}, selected="Cara B")
rh_in_03_2_canto_frontal = ValueList({"Canto": 0, "MDP": 1}, selected="MDP")
rh_in_03_3_canto_trasero = ValueList({"Canto": 0, "MDP": 1}, selected="MDP")
rh_in_03_4canto_izquierdo_arriba = ValueList({"Canto": 0, "MDP": 1}, selected="MDP")
rh_in_03_5_canto_derecho_abajo = ValueList({"Canto": 0, "MDP": 1}, selected="MDP")
segmentacion = ValueList({"Triángulos": 0, "Quads y triángulos (mixto)": 1, "Sólo quads si es posible": 2}, selected="Sólo quads si es posible")
rh_in_03_0_mapeado = ValueList({"Longitudinal": 0, "Atravesada": 1}, selected="Longitudinal")

# Materializer 3.4
python_3_script_2 = Python3Script(
    Brep_In=brep,
    Balance_Mode=rh_in_03_1_lado_balance,
    Canto_1=rh_in_03_2_canto_frontal,
    Canto_2=rh_in_03_3_canto_trasero,
    Canto_3=rh_in_03_4canto_izquierdo_arriba,
    Canto_4=rh_in_03_5_canto_derecho_abajo)  # -> Out, NURBS_Color, NURBS_Balance, NURBS_MDP; inputs Brep_In: list of Brep, Balance_Mode: String, Canto_1: String, Canto_2: String, Canto_3: String, Canto_4: String
# ---------- python_3_script_2: Python ----------
"""
=============================================================================
PROYECTO:      3dBimFab
COMPONENTE:    3dBimFab - Desglosador DfMA de Pieza Real NURBS (Materializer)
VERSIÓN:       3.4 DfMA Inteligencia Total (Simetría Dual + Cierre de Ranuras)
AUTOR:         Mario Mojica & Gamma (3dBimFab Digital Manufacturing Engine)
DESCRIPCIÓN:   Clasifica geométricamente las caras de piezas NURBS / Breps en:
               - Caras Principales (A = Exterior / B = Interior) con auto-detección
                 de simetría (por centroide relativo Xmid y por presencia de ranura).
               - Cantos Perimetrales (1 a 4) planos o chaflanes a 45°.
               - Mecanizados y Ranuras (SIEMPRE a MDP, sin descartar ninguna cara).
               - 100% compatible con Item Access o List Access en Grasshopper.
=============================================================================
"""

import Rhino

def parse_balance(val):
    s = str(val).lower().strip().replace('"', '').replace("'", "")
    if s in ["6", "d/d", "dyd", "doble", "ninguno", "ambas"] or "d/d" in s or "dyd" in s:
        return "DD"
    if s in ["5", "cara a", "a"] or (s.startswith("a") and len(s) <= 6):
        return "A"
    if s in ["4", "cara b", "b"] or (s.startswith("b") and len(s) <= 6):
        return "B"
    if "ambos" in s:
        return "AMBOS"
    return "B"

def parse_canto(val):
    s = str(val).lower().strip().replace('"', '').replace("'", "")
    if s in ["0", "0.0", "canto", "true", "si", "sí", "con canto"] or ("canto" in s and "sin" not in s):
        return True # Madera / Color
    if s in ["1", "1.0", "mdp", "false", "no", "sin canto"] or "mdp" in s or "sin" in s:
        return False # Crudo / MDP
    return True

def clasificar_brep_individual(brep_in, balance_mode="Cara B", c1="Canto", c2="Canto", c3="Canto", c4="Canto", is_left=None):
    if brep_in is None:
        return [], [], [], "Aviso: Brep nulo"

    bbox = brep_in.GetBoundingBox(True)
    x0, x1 = bbox.Min.X, bbox.Max.X
    y0, y1 = bbox.Min.Y, bbox.Max.Y
    z0, z1 = bbox.Min.Z, bbox.Max.Z

    sx = max(0.1, x1 - x0)
    sy = max(0.1, y1 - y0)
    sz = max(0.1, z1 - z0)
    min_dim = min(sx, sy, sz)

    # Tolerancia geométrica adaptativa (invariante a escala metros/milímetros)
    tol = max(0.0002, min_dim * 0.15)
    zona_bisel = min_dim * 2.2

    # Detección anatómica de simetría si is_left no vino definido externamente
    if is_left is None and min_dim == sx:
        count_x0 = 0
        count_x1 = 0
        for i in range(brep_in.Faces.Count):
            f = brep_in.Faces[i]
            if f.IsPlanar():
                u = (f.Domain(0).T0 + f.Domain(0).T1) * 0.5
                v = (f.Domain(1).T0 + f.Domain(1).T1) * 0.5
                pt = f.PointAt(u, v)
                n = f.NormalAt(u, v)
                n.Unitize()
                if n.X < -0.85 and abs(pt.X - x0) < tol:
                    count_x0 += 1
                elif n.X > 0.85 and abs(pt.X - x1) < tol:
                    count_x1 += 1
        
        # En un lateral de cajón, el lado interior tiene al menos 2 caras por la ranura (arriba y abajo)
        # mientras que el lado exterior es 1 sola cara continua.
        if count_x1 > count_x0:
            # Más caras en +X (ranura interior hacia +X) -> Lateral Izquierdo
            is_left = True
        elif count_x0 > count_x1:
            # Más caras en -X (ranura interior hacia -X) -> Lateral Derecho
            is_left = False
        else:
            xc = (x0 + x1) * 0.5
            is_left = (xc < 0)

    faces_A = []
    faces_B = []
    faces_cantos = {1: [], 2: [], 3: [], 4: []}
    faces_mecanizados = []

    for i in range(brep_in.Faces.Count):
        f = brep_in.Faces[i]
        nurbs_face = f.DuplicateFace(False)

        if not f.IsPlanar():
            faces_mecanizados.append(nurbs_face)
            continue

        u = (f.Domain(0).T0 + f.Domain(0).T1) * 0.5
        v = (f.Domain(1).T0 + f.Domain(1).T1) * 0.5
        pt = f.PointAt(u, v)
        n = f.NormalAt(u, v)
        n.Unitize()

        # -----------------------------------------------------------------
        # CASO 1: Tablero Horizontal (Cubiertas / Entrepaños / Fondos cajón - Espesor en Z)
        # -----------------------------------------------------------------
        if min_dim == sz:
            tipo_str = "Horizontal (Cubierta/Entrepaño/Fondo)"
            if n.Z > 0.85 and abs(pt.Z - z1) < tol:
                faces_A.append(nurbs_face)
            elif n.Z < -0.85 and abs(pt.Z - z0) < tol:
                faces_B.append(nurbs_face)
            # Canto 1: Frontal (-Y)
            elif (n.Y < -0.85 and abs(pt.Y - y0) < tol) or (-0.85 < n.Y < -0.30 and (pt.Y - y0) < zona_bisel and abs(pt.Z - ((z0+z1)*0.5)) < (sz * 0.6)):
                faces_cantos[1].append(nurbs_face)
            # Canto 2: Trasero (+Y)
            elif (n.Y > 0.85 and abs(pt.Y - y1) < tol) or (0.30 < n.Y < 0.85 and (y1 - pt.Y) < zona_bisel and abs(pt.Z - ((z0+z1)*0.5)) < (sz * 0.6)):
                faces_cantos[2].append(nurbs_face)
            # Canto 3: Izquierdo (-X)
            elif (n.X < -0.85 and abs(pt.X - x0) < tol) or (-0.85 < n.X < -0.30 and (pt.X - x0) < zona_bisel and abs(pt.Z - ((z0+z1)*0.5)) < (sz * 0.6)):
                faces_cantos[3].append(nurbs_face)
            # Canto 4: Derecho (+X)
            elif (n.X > 0.85 and abs(pt.X - x1) < tol) or (0.30 < n.X < 0.85 and (x1 - pt.X) < zona_bisel and abs(pt.Z - ((z0+z1)*0.5)) < (sz * 0.6)):
                faces_cantos[4].append(nurbs_face)
            else:
                faces_mecanizados.append(nurbs_face)

        # -----------------------------------------------------------------
        # CASO 2: Tablero Vertical Lateral (Costados / Laterales Cajón - Espesor en X)
        # -----------------------------------------------------------------
        elif min_dim == sx:
            tipo_str = "Vertical Lateral (Costado/Lateral Cajón {})".format("IZQ" if is_left else "DER")
            
            # Detectar caras límites exteriores en x0 (-X) y x1 (+X)
            # En un lateral con ranura, la cara interior está dividida por la ranura (>= 2 caras)
            # y la cara exterior es una sola cara continua (1 cara).
            faces_x0 = []
            faces_x1 = []
            
            # Cantos y mecanizados se van clasificando
            for f_idx in range(brep_in.Faces.Count):
                f_cur = brep_in.Faces[f_idx]
                n_face = f_cur.DuplicateFace(False)
                if not f_cur.IsPlanar():
                    faces_mecanizados.append(n_face)
                    continue
                u = (f_cur.Domain(0).T0 + f_cur.Domain(0).T1) * 0.5
                v = (f_cur.Domain(1).T0 + f_cur.Domain(1).T1) * 0.5
                pt = f_cur.PointAt(u, v)
                n = f_cur.NormalAt(u, v)
                n.Unitize()
                
                if n.X < -0.85 and abs(pt.X - x0) < tol:
                    faces_x0.append(n_face)
                elif n.X > 0.85 and abs(pt.X - x1) < tol:
                    faces_x1.append(n_face)
                elif (n.Y < -0.85 and abs(pt.Y - y0) < tol) or (-0.85 < n.Y < -0.30 and (pt.Y - y0) < zona_bisel and abs(pt.X - ((x0+x1)*0.5)) < (sx * 0.6)):
                    faces_cantos[1].append(n_face)
                elif (n.Y > 0.85 and abs(pt.Y - y1) < tol) or (0.30 < n.Y < 0.85 and (y1 - pt.Y) < zona_bisel and abs(pt.X - ((x0+x1)*0.5)) < (sx * 0.6)):
                    faces_cantos[2].append(n_face)
                elif (n.Z > 0.85 and abs(pt.Z - z1) < tol) or (0.30 < n.Z < 0.85 and (z1 - pt.Z) < zona_bisel and abs(pt.X - ((x0+x1)*0.5)) < (sx * 0.6)):
                    faces_cantos[3].append(n_face)
                elif (n.Z < -0.85 and abs(pt.Z - z0) < tol) or (-0.85 < n.Z < -0.30 and (pt.Z - z0) < zona_bisel and abs(pt.X - ((x0+x1)*0.5)) < (sx * 0.6)):
                    faces_cantos[4].append(n_face)
                else:
                    faces_mecanizados.append(n_face)
            
            # Asignación DfMA infalible:
            # Cara B = Siempre Interior (con ranura)
            # Cara A = Siempre Exterior (lisa continua)
            if len(faces_x1) > len(faces_x0):
                # Interior está en +X (Lateral Izquierdo)
                faces_A.extend(faces_x0)
                faces_B.extend(faces_x1)
            elif len(faces_x0) > len(faces_x1):
                # Interior está en -X (Lateral Derecho)
                faces_A.extend(faces_x1)
                faces_B.extend(faces_x0)
            else:
                # Si son iguales (sin ranura), usar is_left
                if is_left:
                    faces_A.extend(faces_x0)
                    faces_B.extend(faces_x1)
                else:
                    faces_A.extend(faces_x1)
                    faces_B.extend(faces_x0)
            
            # Saltamos el bucle individual ya que procesamos todas las caras de este Brep
            break

        # -----------------------------------------------------------------
        # CASO 3: Tablero Vertical Frontal (Frentes / Traseras Cajón / Puertas / Zócalos - Espesor en Y)
        # -----------------------------------------------------------------
        else:
            tipo_str = "Vertical Frontal (Frente/Trasera/Puerta)"
            if n.Y < -0.85 and abs(pt.Y - y0) < tol:
                faces_A.append(nurbs_face)
            elif n.Y > 0.85 and abs(pt.Y - y1) < tol:
                faces_B.append(nurbs_face)
            # Canto 1: Superior (+Z)
            elif (n.Z > 0.85 and abs(pt.Z - z1) < tol) or (0.30 < n.Z < 0.85 and (z1 - pt.Z) < zona_bisel and abs(pt.Y - ((y0+y1)*0.5)) < (sy * 0.6)):
                faces_cantos[1].append(nurbs_face)
            # Canto 2: Inferior (-Z)
            elif (n.Z < -0.85 and abs(pt.Z - z0) < tol) or (-0.85 < n.Z < -0.30 and (pt.Z - z0) < zona_bisel and abs(pt.Y - ((y0+y1)*0.5)) < (sy * 0.6)):
                faces_cantos[2].append(nurbs_face)
            # Canto 3: Izquierdo (-X)
            elif (n.X < -0.85 and abs(pt.X - x0) < tol) or (-0.85 < n.X < -0.30 and (pt.X - x0) < zona_bisel and abs(pt.Y - ((y0+y1)*0.5)) < (sy * 0.6)):
                faces_cantos[3].append(nurbs_face)
            # Canto 4: Derecho (+X)
            elif (n.X > 0.85 and abs(pt.X - x1) < tol) or (0.30 < n.X < 0.85 and (x1 - pt.X) < zona_bisel and abs(pt.Y - ((y0+y1)*0.5)) < (sy * 0.6)):
                faces_cantos[4].append(nurbs_face)
            else:
                faces_mecanizados.append(nurbs_face)

    # 3. Asignación de Caras Principales según Balance
    modo_b = parse_balance(balance_mode)
    nurbs_color = []
    nurbs_balance = []
    nurbs_mdp = []

    if modo_b == "DD":
        nurbs_color.extend(faces_A)
        nurbs_color.extend(faces_B)
        diag_bal = "D/D (Doble Cara Madera)"
    elif modo_b == "A":
        nurbs_balance.extend(faces_A)
        nurbs_color.extend(faces_B)
        diag_bal = "Balance en Cara A (Exterior)"
    elif modo_b == "B":
        nurbs_color.extend(faces_A)
        nurbs_balance.extend(faces_B)
        diag_bal = "Balance en Cara B (Interior)"
    else:
        nurbs_balance.extend(faces_A)
        nurbs_balance.extend(faces_B)
        diag_bal = "Ambas Caras Balance"

    # 4. Asignación de Cantos
    cantos_in = {
        1: parse_canto(c1),
        2: parse_canto(c2),
        3: parse_canto(c3),
        4: parse_canto(c4)
    }

    for num_canto, tiene_canto in cantos_in.items():
        if tiene_canto:
            nurbs_color.extend(faces_cantos[num_canto])
        else:
            nurbs_mdp.extend(faces_cantos[num_canto])

    # 5. Mecanizados y barrenos siempre van a MDP
    nurbs_mdp.extend(faces_mecanizados)

    diag = "{0} | {1} | Caras: {2} (A={3}, B={4}, Cantos={5}, Mec={6})".format(
        tipo_str, diag_bal, brep_in.Faces.Count,
        len(faces_A), len(faces_B), sum(len(v) for v in faces_cantos.values()), len(faces_mecanizados)
    )

    return nurbs_color, nurbs_balance, nurbs_mdp, diag

def ejecutar_materializer_dfma(brep_input, b_mode, c1, c2, c3, c4):
    if brep_input is None:
        return [], [], [], "Brep nulo"

    if hasattr(brep_input, "__iter__") and not hasattr(brep_input, "Faces"):
        breps = [b for b in brep_input if b is not None]
    else:
        breps = [brep_input]

    if not breps:
        return [], [], [], "Lista de Breps vacía"

    is_left_flags = [None] * len(breps)
    if len(breps) > 1:
        bboxes = []
        for b in breps:
            bb = b.GetBoundingBox(True)
            bboxes.append({
                "xc": (bb.Min.X + bb.Max.X) * 0.5,
                "yc": (bb.Min.Y + bb.Max.Y) * 0.5,
                "zc": (bb.Min.Z + bb.Max.Z) * 0.5,
                "sx": bb.Max.X - bb.Min.X,
                "sy": bb.Max.Y - bb.Min.Y,
                "sz": bb.Max.Z - bb.Min.Z
            })

        # Calcular X_min y X_max global del grupo de laterales (funciona en metros y milímetros)
        xs = [info["xc"] for info in bboxes if min(info["sx"], info["sy"], info["sz"]) == info["sx"]]
        if len(xs) >= 2 and (max(xs) - min(xs)) > 0.05:
            mid_x_global = (min(xs) + max(xs)) * 0.5
            for i, info in enumerate(bboxes):
                if min(info["sx"], info["sy"], info["sz"]) == info["sx"]:
                    is_left_flags[i] = (info["xc"] < mid_x_global)

    all_col = []
    all_bal = []
    all_mdp = []
    diag_lines = []

    for idx, b in enumerate(breps):
        flag = is_left_flags[idx]
        col, bal, mdp, diag = clasificar_brep_individual(b, b_mode, c1, c2, c3, c4, is_left=flag)
        all_col.extend(col)
        all_bal.extend(bal)
        all_mdp.extend(mdp)
        diag_lines.append("P{0}: {1}".format(idx+1, diag))

    res_diag = " | ".join(diag_lines) if len(diag_lines) <= 3 else "{0} piezas procesadas DfMA. {1}".format(len(breps), diag_lines[0])
    return all_col, all_bal, all_mdp, res_diag

# =============================================================================
# EJECUCIÓN GRASSHOPPER
# =============================================================================
_b_mode = Balance_Mode if 'Balance_Mode' in locals() and Balance_Mode is not None else "Cara B"
_c1 = Canto_1 if 'Canto_1' in locals() and Canto_1 is not None else "Canto"
_c2 = Canto_2 if 'Canto_2' in locals() and Canto_2 is not None else "Canto"
_c3 = Canto_3 if 'Canto_3' in locals() and Canto_3 is not None else "Canto"
_c4 = Canto_4 if 'Canto_4' in locals() and Canto_4 is not None else "Canto"

NURBS_Color, NURBS_Balance, NURBS_MDP, Out = ejecutar_materializer_dfma(
    Brep_In, _b_mode, _c1, _c2, _c3, _c4
)

out = Out
a = Out
Info_Pieza = Out
print(Out)
# ---------- end python_3_script_2 ----------

# ---- group: Frente de Cajon
rh_in_02_1_lado_balance = ValueList({"Cara A", "Cara B", "D/D"}, selected="Cara B")
rh_in_02_2_canto_frontal = ValueList({"Canto": 0, "MDP": 1}, selected="MDP")
rh_in_02_3_canto_trasero = ValueList({"Canto": 0, "MDP": 1}, selected="MDP")
rh_in_02_4canto_izquierdo_arriba = ValueList({"Canto": 0, "MDP": 1}, selected="MDP")
rh_in_02_5_canto_derecho_abajo = ValueList({"Canto": 0, "MDP": 1}, selected="MDP")
segmentacion_2 = ValueList({"Triángulos": 0, "Quads y triángulos (mixto)": 1, "Sólo quads si es posible": 2}, selected="Sólo quads si es posible")
rh_in_02_0_mapeado = ValueList({"Longitudinal": 0, "Atravesada": 1}, selected="Longitudinal")

# Materializer 3.4
python_3_script_3 = Python3Script(
    Brep_In=brep_2,
    Balance_Mode=rh_in_02_1_lado_balance,
    Canto_1=rh_in_02_2_canto_frontal,
    Canto_2=rh_in_02_3_canto_trasero,
    Canto_3=rh_in_02_4canto_izquierdo_arriba,
    Canto_4=rh_in_02_5_canto_derecho_abajo)  # -> Out, NURBS_Color, NURBS_Balance, NURBS_MDP; inputs Brep_In: list of Brep, Balance_Mode: String, Canto_1: String, Canto_2: String, Canto_3: String, Canto_4: String; same code as python_3_script_2

# ---- group: Cubierta Superior
rh_in_08_1_lado_balance = ValueList({"Cara A", "Cara B", "D/D"}, selected="Cara B")
rh_in_08_2_canto_frontal = ValueList({"Canto": 0, "MDP": 1}, selected="MDP")
rh_in_08_4canto_izquierdo_arriba = ValueList({"Canto": 0, "MDP": 1}, selected="MDP")
rh_in_08_5_canto_derecho_abajo = ValueList({"Canto": 0, "MDP": 1}, selected="MDP")
rh_in_08_3_canto_trasero = ValueList({"Canto": 0, "MDP": 1}, selected="MDP")
segmentacion_3 = ValueList({"Triángulos": 0, "Quads y triángulos (mixto)": 1, "Sólo quads si es posible": 2}, selected="Sólo quads si es posible")
rh_in_08_0_mapeado = ValueList({"Longitudinal": 0, "Atravesada": 1}, selected="Longitudinal")

# Materializer 3.4
python_3_script_4 = Python3Script(
    Brep_In=brep_6,
    Balance_Mode=rh_in_08_1_lado_balance,
    Canto_1=rh_in_08_2_canto_frontal,
    Canto_2=rh_in_08_3_canto_trasero,
    Canto_3=rh_in_08_4canto_izquierdo_arriba,
    Canto_4=rh_in_08_5_canto_derecho_abajo)  # -> Out, NURBS_Color, NURBS_Balance, NURBS_MDP; inputs Brep_In: list of Brep, Balance_Mode: String, Canto_1: String, Canto_2: String, Canto_3: String, Canto_4: String; same code as python_3_script_2

# ---- group: Fondos de Cajon
rh_in_09_1_lado_balance = ValueList({"Cara A", "Cara B", "D/D"}, selected="Cara B")
rh_in_09_2_canto_frontal = ValueList({"Canto": 0, "MDP": 1}, selected="MDP")
rh_in_09_4canto_izquierdo_arriba = ValueList({"Canto": 0, "MDP": 1}, selected="MDP")
rh_in_09_5_canto_derecho_abajo = ValueList({"Canto": 0, "MDP": 1}, selected="MDP")
rh_in_09_3_canto_trasero = ValueList({"Canto": 0, "MDP": 1}, selected="MDP")
segmentacion_4 = ValueList({"Triángulos": 0, "Quads y triángulos (mixto)": 1, "Sólo quads si es posible": 2}, selected="Sólo quads si es posible")
rh_in_09_0_mapeado = ValueList({"Longitudinal": 0, "Atravesada": 1}, selected="Longitudinal")

# Materializer 3.4
python_3_script_5 = Python3Script(
    Brep_In=brep_3,
    Balance_Mode=rh_in_09_1_lado_balance,
    Canto_1=rh_in_09_2_canto_frontal,
    Canto_2=rh_in_09_3_canto_trasero,
    Canto_3=rh_in_09_4canto_izquierdo_arriba,
    Canto_4=rh_in_09_5_canto_derecho_abajo)  # -> Out, NURBS_Color, NURBS_Balance, NURBS_MDP; inputs Brep_In: list of Brep, Balance_Mode: String, Canto_1: String, Canto_2: String, Canto_3: String, Canto_4: String; same code as python_3_script_2

# ---- group: Costado Derecho
rh_in_05_1_lado_balance = ValueList({"Cara A", "Cara B", "D/D"}, selected="Cara B")
rh_in_05_2_canto_frontal = ValueList({"Canto": 0, "MDP": 1}, selected="MDP")
rh_in_05_4canto_izquierdo_arriba = ValueList({"Canto": 0, "MDP": 1}, selected="MDP")
rh_in_05_5_canto_derecho_abajo = ValueList({"Canto": 0, "MDP": 1}, selected="MDP")
rh_in_05_3_canto_trasero = ValueList({"Canto": 0, "MDP": 1}, selected="MDP")
segmentacion_5 = ValueList({"Triángulos": 0, "Quads y triángulos (mixto)": 1, "Sólo quads si es posible": 2}, selected="Sólo quads si es posible")
rh_in_05_0_mapeado = ValueList({"Longitudinal": 0, "Atravesada": 1}, selected="Longitudinal")

# Materializer 3.4
python_3_script_6 = Python3Script(
    Brep_In=brep_4,
    Balance_Mode=rh_in_05_1_lado_balance,
    Canto_1=rh_in_05_2_canto_frontal,
    Canto_2=rh_in_05_3_canto_trasero,
    Canto_3=rh_in_05_4canto_izquierdo_arriba,
    Canto_4=rh_in_05_5_canto_derecho_abajo)  # -> Out, NURBS_Color, NURBS_Balance, NURBS_MDP; inputs Brep_In: list of Brep, Balance_Mode: String, Canto_1: String, Canto_2: String, Canto_3: String, Canto_4: String; same code as python_3_script_2

# ---- group: Espaldares
rh_in_10_1_lado_balance = ValueList({"Cara A", "Cara B", "D/D"}, selected="Cara B")
rh_in_10_2_canto_frontal = ValueList({"Canto": 0, "MDP": 1}, selected="MDP")
rh_in_10_4canto_izquierdo_arriba = ValueList({"Canto": 0, "MDP": 1}, selected="MDP")
rh_in_10_5_canto_derecho_abajo = ValueList({"Canto": 0, "MDP": 1}, selected="MDP")
rh_in_10_3_canto_trasero = ValueList({"Canto": 0, "MDP": 1}, selected="MDP")
segmentacion_6 = ValueList({"Triángulos": 0, "Quads y triángulos (mixto)": 1, "Sólo quads si es posible": 2}, selected="Sólo quads si es posible")
rh_in_10_0_mapeado = ValueList({"Longitudinal": 0, "Atravesada": 1}, selected="Longitudinal")

# Materializer 3.4
python_3_script_7 = Python3Script(
    Brep_In=brep_7,
    Balance_Mode=rh_in_10_1_lado_balance,
    Canto_1=rh_in_10_2_canto_frontal,
    Canto_2=rh_in_10_3_canto_trasero,
    Canto_3=rh_in_10_4canto_izquierdo_arriba,
    Canto_4=rh_in_10_5_canto_derecho_abajo)  # -> Out, NURBS_Color, NURBS_Balance, NURBS_MDP; inputs Brep_In: list of Brep, Balance_Mode: String, Canto_1: String, Canto_2: String, Canto_3: String, Canto_4: String; same code as python_3_script_2

# ---- group: Tapaluces IZ
rh_in_04_1_lado_balance = ValueList({"Cara A", "Cara B", "D/D"}, selected="Cara B")
rh_in_04_2_canto_frontal = ValueList({"Canto": 0, "MDP": 1}, selected="MDP")
rh_in_04_3_canto_trasero = ValueList({"Canto": 0, "MDP": 1}, selected="MDP")
rh_in_04_4canto_izquierdo_arriba = ValueList({"Canto": 0, "MDP": 1}, selected="MDP")
rh_in_04_5_canto_derecho_abajo = ValueList({"Canto": 0, "MDP": 1}, selected="MDP")
segmentacion_7 = ValueList({"Triángulos": 0, "Quads y triángulos (mixto)": 1, "Sólo quads si es posible": 2}, selected="Sólo quads si es posible")
rh_in_04_0_mapeado = ValueList({"Longitudinal": 0, "Atravesada": 1}, selected="Longitudinal")

# Materializer 3.4
python_3_script_8 = Python3Script(
    Brep_In=brep_8,
    Balance_Mode=rh_in_04_1_lado_balance,
    Canto_1=rh_in_04_2_canto_frontal,
    Canto_2=rh_in_04_3_canto_trasero,
    Canto_3=rh_in_04_4canto_izquierdo_arriba,
    Canto_4=rh_in_04_5_canto_derecho_abajo)  # -> Out, NURBS_Color, NURBS_Balance, NURBS_MDP; inputs Brep_In: list of Brep, Balance_Mode: String, Canto_1: String, Canto_2: String, Canto_3: String, Canto_4: String; same code as python_3_script_2

# ---- group: Posterior de Cajon
rh_in_07_1_lado_balance = ValueList({"Cara A", "Cara B", "D/D"}, selected="Cara B")
rh_in_07_2_canto_frontal = ValueList({"Canto": 0, "MDP": 1}, selected="MDP")
rh_in_07_4canto_izquierdo_arriba = ValueList({"Canto": 0, "MDP": 1}, selected="MDP")
rh_in_07_5_canto_derecho_abajo = ValueList({"Canto": 0, "MDP": 1}, selected="MDP")
rh_in_07_3_canto_trasero = ValueList({"Canto": 0, "MDP": 1}, selected="MDP")
segmentacion_8 = ValueList({"Triángulos": 0, "Quads y triángulos (mixto)": 1, "Sólo quads si es posible": 2}, selected="Sólo quads si es posible")
rh_in_07_0_mapeado = ValueList({"Longitudinal": 0, "Atravesada": 1}, selected="Longitudinal")

# Materializer 3.4
python_3_script_9 = Python3Script(
    Brep_In=brep_5,
    Balance_Mode=rh_in_07_1_lado_balance,
    Canto_1=rh_in_07_2_canto_frontal,
    Canto_2=rh_in_07_3_canto_trasero,
    Canto_3=rh_in_07_4canto_izquierdo_arriba,
    Canto_4=rh_in_07_5_canto_derecho_abajo)  # -> Out, NURBS_Color, NURBS_Balance, NURBS_MDP; inputs Brep_In: list of Brep, Balance_Mode: String, Canto_1: String, Canto_2: String, Canto_3: String, Canto_4: String; same code as python_3_script_2

# ---- group: Laterales de Cajon
rh_in_06_1_lado_balance = ValueList({"Cara A", "Cara B", "D/D"}, selected="Cara B")
rh_in_06_2_canto_frontal = ValueList({"Canto": 0, "MDP": 1}, selected="MDP")
rh_in_06_4canto_izquierdo_arriba = ValueList({"Canto": 0, "MDP": 1}, selected="MDP")
rh_in_06_5_canto_derecho_abajo = ValueList({"Canto": 0, "MDP": 1}, selected="MDP")
rh_in_06_3_canto_trasero = ValueList({"Canto": 0, "MDP": 1}, selected="MDP")
segmentacion_9 = ValueList({"Triángulos": 0, "Quads y triángulos (mixto)": 1, "Sólo quads si es posible": 2}, selected="Sólo quads si es posible")
rh_in_06_0_mapeado = ValueList({"Longitudinal": 0, "Atravesada": 1}, selected="Longitudinal")

# Materializer 3.4
python_3_script_10 = Python3Script(
    Brep_In=brep_9,
    Balance_Mode=rh_in_06_1_lado_balance,
    Canto_1=rh_in_06_2_canto_frontal,
    Canto_2=rh_in_06_3_canto_trasero,
    Canto_3=rh_in_06_4canto_izquierdo_arriba,
    Canto_4=rh_in_06_5_canto_derecho_abajo)  # -> Out, NURBS_Color, NURBS_Balance, NURBS_MDP; inputs Brep_In: list of Brep, Balance_Mode: String, Canto_1: String, Canto_2: String, Canto_3: String, Canto_4: String; same code as python_3_script_2

# ---- group: Zocalo Frontal (continued)
diagnostico = Panel(python_3_script_2.Out)
mesh_brep = MeshBrep(
    Brep=python_3_script_2.NURBS_Color,
    Settings={GridMaxCount=0, GridMinCount=16, JaggedSeams=False, MaxEdgeLength=0, MinEdgeLength=0.0001, MinTolerance=0, Refine=True, RefineAngle=0, RelativeTolerance=0.65, SimplePlanes=True, Tolerance=0})
mesh_brep_2 = MeshBrep(
    Brep=python_3_script_2.NURBS_Balance,
    Settings={GridMaxCount=0, GridMinCount=16, JaggedSeams=False, MaxEdgeLength=0, MinEdgeLength=0.0001, MinTolerance=0, Refine=True, RefineAngle=0, RelativeTolerance=0.65, SimplePlanes=True, Tolerance=0})
mesh_brep_3 = MeshBrep(
    Brep=python_3_script_2.NURBS_MDP,
    Settings={GridMaxCount=0, GridMinCount=16, JaggedSeams=False, MaxEdgeLength=0, MinEdgeLength=0.0001, MinTolerance=0, Refine=True, RefineAngle=0, RelativeTolerance=0.65, SimplePlanes=True, Tolerance=0})
mesh_join = MeshJoin(Meshes=flatten(mesh_brep))
mesh_join_2 = MeshJoin(Meshes=flatten(mesh_brep_2))
mesh_join_3 = MeshJoin(Meshes=flatten(mesh_brep_3))
reduce_mesh = ReduceMesh(Mesh=mesh_join_3, FaceCount=20, Accuracy=1, FaceType=segmentacion, Distort=Toggle(False), Normalize=Toggle(True))  # -> Reduced, CountDifference
panel_2 = Panel(reduce_mesh.CountDifference)
python_3_script_11 = Python3Script(M=reduce_mesh.Reduced, B=rh_in_03_0_mapeado)  # -> a; inputs M: Mesh, B: list of Int32
# ---------- python_3_script_11: Python ----------
"""
=============================================================================
PROYECTO:      3dBimFab
COMPONENTE:    3dBimFab - Box Mapping UV Métrico Cohesivo (600mm)
VERSIÓN:       v3.8 - DfMA Anatómico Granular & Cantos Siempre Longitudinales
AUTOR:         Mario Mojica & Gamma (3dBimFab Digital Manufacturing Engine)
DESCRIPCIÓN:   Mapeado métrico de 600 mm para piezas de taller y sólidos DWG:
               - La imagen tiene su veta de izquierda a derecha (Eje U).
               - Descompone mallas unidas (SplitDisjointPieces) para medir
                 las dimensiones físicas reales de cada pieza individual.
               - En Laterales de Cajón (sy > sz): veta corre a lo largo del cajón (Y).
               - En Costados de Mueble (sz >= sy): veta corre en altura vertical (Z).
               - En Cubiertas y Frentes: veta corre longitudinal a lo largo de X.
               - Cantos perimetrales: SIEMPRE longitudinales a su propio filo.
=============================================================================
"""

import Rhino

def extraer_valor_b(val):
    if val is None:
        return False
    while isinstance(val, (list, tuple)) and len(val) > 0:
        val = val[0]
    if hasattr(val, "Value"):
        val = val.Value
    
    s = str(val).lower().strip().replace('"', '').replace("'", "")
    return "atravesad" in s or s in ["1", "1.0", "true", "si", "sí", "3", "5"]

def _mapear_mesh_simple(mesh_in, modo_veta, escala_caja_mm=600.0):
    if mesh_in is None:
        return mesh_in

    mesh = mesh_in.DuplicateMesh() if hasattr(mesh_in, "DuplicateMesh") else mesh_in
    mesh.Normals.ComputeNormals()
    mesh.TextureCoordinates.Clear()

    bbox = mesh.GetBoundingBox(True)
    sx = max(0.001, bbox.Max.X - bbox.Min.X)
    sy = max(0.001, bbox.Max.Y - bbox.Min.Y)
    sz = max(0.001, bbox.Max.Z - bbox.Min.Z)

    min_dim = min(sx, sy, sz)
    es_atravesada = extraer_valor_b(modo_veta)
    escala = float(escala_caja_mm)

    for idx in range(mesh.Vertices.Count):
        v = mesh.Vertices[idx]
        n = mesh.Normals[idx] if idx < mesh.Normals.Count else Rhino.Geometry.Vector3f(0, 0, 1)

        lx = v.X - bbox.Min.X
        ly = v.Y - bbox.Min.Y
        lz = v.Z - bbox.Min.Z

        nx, ny, nz = abs(n.X), abs(n.Y), abs(n.Z)

        # -------------------------------------------------------------
        # CASO 1: Tablero Horizontal (Cubiertas, Entrepaños - Espesor en Z)
        # -------------------------------------------------------------
        if min_dim == sz:
            if nz >= nx and nz >= ny:
                # Cara principal (plano XY)
                u = ly / escala if es_atravesada else lx / escala
                v_coord = lx / escala if es_atravesada else ly / escala
            elif ny >= nx and ny >= nz:
                # Cantos frontal y trasero (en Y): veta longitudinal al filo (en X)
                u = lx / escala
                v_coord = lz / escala
            else:
                # Cantos laterales (en X): veta longitudinal al filo (en Y)
                u = ly / escala
                v_coord = lz / escala

        # -------------------------------------------------------------
        # CASO 2: Tablero Vertical Lateral (Costados / Laterales Cajón - Espesor en X)
        # -------------------------------------------------------------
        elif min_dim == sx:
            if nx >= ny and nx >= nz:
                # Cara principal (plano YZ)
                if sz >= sy:
                    # Costado de Mueble (alto en Z): Longitudinal corre en Z
                    u = ly / escala if es_atravesada else lz / escala
                    v_coord = lz / escala if es_atravesada else ly / escala
                else:
                    # Lateral de Cajón (largo en Y): Longitudinal corre a lo largo del cajón (Y)
                    u = lz / escala if es_atravesada else ly / escala
                    v_coord = ly / escala if es_atravesada else lz / escala
            elif nz >= nx and nz >= ny:
                # Cantos superior e inferior (en Z): veta siempre longitudinal al filo (en Y)
                u = ly / escala
                v_coord = lx / escala
            else:
                # Cantos frontal y trasero (en Y): veta siempre longitudinal al filo (en Z)
                u = lz / escala
                v_coord = lx / escala

        # -------------------------------------------------------------
        # CASO 3: Tablero Vertical Frontal (Frentes, Zócalos - Espesor en Y)
        # -------------------------------------------------------------
        else:
            if ny >= nx and ny >= nz:
                # Cara principal (plano XZ): Longitudinal corre horizontal en X
                u = lz / escala if es_atravesada else lx / escala
                v_coord = lx / escala if es_atravesada else lz / escala
            elif nz >= nx and nz >= ny:
                # Cantos superior e inferior (en Z): veta longitudinal al filo (en X)
                u = lx / escala
                v_coord = ly / escala
            else:
                # Cantos laterales (en X): veta longitudinal al filo (en Z)
                u = lz / escala
                v_coord = ly / escala

        mesh.TextureCoordinates.Add(float(u), float(v_coord))

    return mesh

def aplicar_box_mapping_profesional(mesh_in, modo_veta=0, escala_caja_mm=600.0):
    if mesh_in is None or not isinstance(mesh_in, Rhino.Geometry.Mesh):
        return mesh_in

    if hasattr(mesh_in, "SplitDisjointPieces"):
        piezas = mesh_in.SplitDisjointPieces()
    else:
        piezas = [mesh_in]

    if len(piezas) > 1:
        mesh_out = Rhino.Geometry.Mesh()
        for p in piezas:
            p_mapped = _mapear_mesh_simple(p, modo_veta, escala_caja_mm)
            mesh_out.Append(p_mapped)
        return mesh_out
    else:
        return _mapear_mesh_simple(mesh_in, modo_veta, escala_caja_mm)

# =============================================================================
# INYECCIÓN Y EJECUCIÓN (Compatible con List Access en B)
# =============================================================================
val_b = B if 'B' in locals() and B is not None else 0

if isinstance(M, list):
    a = [aplicar_box_mapping_profesional(item, val_b, 600.0) for item in M if item is not None]
else:
    a = aplicar_box_mapping_profesional(M, val_b, 600.0)
# ---------- end python_3_script_11 ----------
python_3_script_12 = Python3Script(M=mesh_join_2, B=rh_in_03_0_mapeado)  # -> a; inputs M: Mesh, B: list of Int32; same code as python_3_script_11
rh_out_mdp_zocalo_frontal = Geometry(python_3_script_11)
rh_out_zocalo_frontal_b = Geometry(python_3_script_12)

# ----
# Box Mapping 3.8
python_3_script_13 = Python3Script(M=mesh_join, B=rh_in_03_0_mapeado)  # -> a; inputs M: Mesh, B: list of Int32; same code as python_3_script_11

# ---- group: Zocalo Frontal (continued)
rh_out_zocalo_frontal = Geometry(python_3_script_13)

# ---- group: Frente de Cajon (continued)
diagnostico_2 = Panel(python_3_script_3.Out)
mesh_brep_4 = MeshBrep(
    Brep=python_3_script_3.NURBS_Color,
    Settings={GridMaxCount=0, GridMinCount=16, JaggedSeams=False, MaxEdgeLength=0, MinEdgeLength=0.0001, MinTolerance=0, Refine=True, RefineAngle=0, RelativeTolerance=0.65, SimplePlanes=True, Tolerance=0})
mesh_brep_5 = MeshBrep(
    Brep=python_3_script_3.NURBS_Balance,
    Settings={GridMaxCount=0, GridMinCount=16, JaggedSeams=False, MaxEdgeLength=0, MinEdgeLength=0.0001, MinTolerance=0, Refine=True, RefineAngle=0, RelativeTolerance=0.65, SimplePlanes=True, Tolerance=0})
mesh_brep_6 = MeshBrep(
    Brep=python_3_script_3.NURBS_MDP,
    Settings={GridMaxCount=0, GridMinCount=16, JaggedSeams=False, MaxEdgeLength=0, MinEdgeLength=0.0001, MinTolerance=0, Refine=True, RefineAngle=0, RelativeTolerance=0.65, SimplePlanes=True, Tolerance=0})
mesh_join_4 = MeshJoin(Meshes=flatten(mesh_brep_4))
mesh_join_5 = MeshJoin(Meshes=flatten(mesh_brep_5))
mesh_join_6 = MeshJoin(Meshes=flatten(mesh_brep_6))
reduce_mesh_2 = ReduceMesh(Mesh=mesh_join_6, FaceCount=20, Accuracy=1, FaceType=segmentacion_2, Distort=Toggle(False), Normalize=Toggle(True))  # -> Reduced, CountDifference
panel_3 = Panel(reduce_mesh_2.CountDifference)
python_3_script_14 = Python3Script(M=reduce_mesh_2.Reduced, B=rh_in_02_0_mapeado)  # -> a; inputs M: Mesh, B: list of Int32; same code as python_3_script_11
python_3_script_15 = Python3Script(M=mesh_join_5, B=rh_in_02_0_mapeado)  # -> a; inputs M: Mesh, B: list of Int32; same code as python_3_script_11
rh_out_mdp_frente_de_cajon = Geometry(python_3_script_14)
rh_out_frente_de_cajon_b = Geometry(python_3_script_15)

# ----
# Box Mapping 3.8
python_3_script_16 = Python3Script(M=mesh_join_4, B=rh_in_02_0_mapeado)  # -> a; inputs M: Mesh, B: list of Int32; same code as python_3_script_11

# ---- group: Frente de Cajon (continued)
rh_out_frente_de_cajon = Geometry(python_3_script_16)

# ---- group: Costado Derecho (continued)
diagnostico_3 = Panel(python_3_script_6.Out)
mesh_brep_7 = MeshBrep(
    Brep=python_3_script_6.NURBS_Color,
    Settings={GridMaxCount=0, GridMinCount=16, JaggedSeams=False, MaxEdgeLength=0, MinEdgeLength=0.0001, MinTolerance=0, Refine=True, RefineAngle=0, RelativeTolerance=0.65, SimplePlanes=True, Tolerance=0})
mesh_brep_8 = MeshBrep(
    Brep=python_3_script_6.NURBS_Balance,
    Settings={GridMaxCount=0, GridMinCount=16, JaggedSeams=False, MaxEdgeLength=0, MinEdgeLength=0.0001, MinTolerance=0, Refine=True, RefineAngle=0, RelativeTolerance=0.65, SimplePlanes=True, Tolerance=0})
mesh_brep_9 = MeshBrep(
    Brep=python_3_script_6.NURBS_MDP,
    Settings={GridMaxCount=0, GridMinCount=16, JaggedSeams=False, MaxEdgeLength=0, MinEdgeLength=0.0001, MinTolerance=0, Refine=True, RefineAngle=0, RelativeTolerance=0.65, SimplePlanes=True, Tolerance=0})
mesh_join_7 = MeshJoin(Meshes=flatten(mesh_brep_7))
mesh_join_8 = MeshJoin(Meshes=flatten(mesh_brep_8))
mesh_join_9 = MeshJoin(Meshes=flatten(mesh_brep_9))
reduce_mesh_3 = ReduceMesh(Mesh=mesh_join_9, FaceCount=20, Accuracy=1, FaceType=segmentacion_5, Distort=Toggle(False), Normalize=Toggle(True))  # -> Reduced, CountDifference
panel_4 = Panel(reduce_mesh_3.CountDifference)
python_3_script_17 = Python3Script(M=reduce_mesh_3.Reduced, B=rh_in_05_0_mapeado)  # -> a; inputs M: Mesh, B: list of Int32; same code as python_3_script_11
python_3_script_18 = Python3Script(M=mesh_join_8, B=rh_in_05_0_mapeado)  # -> a; inputs M: Mesh, B: list of Int32; same code as python_3_script_11
rh_out_mdp_costado_derecho = Geometry(python_3_script_17)
rh_out_costado_derecho_b = Geometry(python_3_script_18)

# ----
# Box Mapping 3.8
python_3_script_19 = Python3Script(M=mesh_join_7, B=rh_in_05_0_mapeado)  # -> a; inputs M: Mesh, B: list of Int32; same code as python_3_script_11

# ---- group: Costado Derecho (continued)
rh_out_costado_derecho = Geometry(python_3_script_19)

# ---- group: Cubierta Superior (continued)
diagnostico_4 = Panel(python_3_script_4.Out)
mesh_brep_10 = MeshBrep(
    Brep=python_3_script_4.NURBS_Color,
    Settings={GridMaxCount=0, GridMinCount=16, JaggedSeams=False, MaxEdgeLength=0, MinEdgeLength=0.0001, MinTolerance=0, Refine=True, RefineAngle=0, RelativeTolerance=0.65, SimplePlanes=True, Tolerance=0})
mesh_brep_11 = MeshBrep(
    Brep=python_3_script_4.NURBS_Balance,
    Settings={GridMaxCount=0, GridMinCount=16, JaggedSeams=False, MaxEdgeLength=0, MinEdgeLength=0.0001, MinTolerance=0, Refine=True, RefineAngle=0, RelativeTolerance=0.65, SimplePlanes=True, Tolerance=0})
mesh_brep_12 = MeshBrep(
    Brep=python_3_script_4.NURBS_MDP,
    Settings={GridMaxCount=0, GridMinCount=16, JaggedSeams=False, MaxEdgeLength=0, MinEdgeLength=0.0001, MinTolerance=0, Refine=True, RefineAngle=0, RelativeTolerance=0.65, SimplePlanes=True, Tolerance=0})
mesh_join_10 = MeshJoin(Meshes=flatten(mesh_brep_10))
mesh_join_11 = MeshJoin(Meshes=flatten(mesh_brep_11))
mesh_join_12 = MeshJoin(Meshes=flatten(mesh_brep_12))
reduce_mesh_4 = ReduceMesh(Mesh=mesh_join_12, FaceCount=20, Accuracy=1, FaceType=segmentacion_3, Distort=Toggle(False), Normalize=Toggle(True))  # -> Reduced, CountDifference
panel_5 = Panel(reduce_mesh_4.CountDifference)
python_3_script_20 = Python3Script(M=reduce_mesh_4.Reduced, B=rh_in_08_0_mapeado)  # -> a; inputs M: Mesh, B: list of Int32; same code as python_3_script_11
python_3_script_21 = Python3Script(M=mesh_join_11, B=rh_in_08_0_mapeado)  # -> a; inputs M: Mesh, B: list of Int32; same code as python_3_script_11
rh_out_mdp_cubierta_superior = Geometry(python_3_script_20)
rh_out_cubierta_superior_b = Geometry(python_3_script_21)

# Box Mapping 3.8
python_3_script_22 = Python3Script(M=mesh_join_10, B=rh_in_08_0_mapeado)  # -> a; inputs M: Mesh, B: list of Int32; same code as python_3_script_11

rh_out_cubierta_superior = Geometry(python_3_script_22)

# ---- group: Fondos de Cajon (continued)
diagnostico_5 = Panel(python_3_script_5.Out)
mesh_brep_13 = MeshBrep(
    Brep=python_3_script_5.NURBS_Color,
    Settings={GridMaxCount=0, GridMinCount=16, JaggedSeams=False, MaxEdgeLength=0, MinEdgeLength=0.0001, MinTolerance=0, Refine=True, RefineAngle=0, RelativeTolerance=0.65, SimplePlanes=True, Tolerance=0})
mesh_brep_14 = MeshBrep(
    Brep=python_3_script_5.NURBS_Balance,
    Settings={GridMaxCount=0, GridMinCount=16, JaggedSeams=False, MaxEdgeLength=0, MinEdgeLength=0.0001, MinTolerance=0, Refine=True, RefineAngle=0, RelativeTolerance=0.65, SimplePlanes=True, Tolerance=0})
mesh_brep_15 = MeshBrep(
    Brep=python_3_script_5.NURBS_MDP,
    Settings={GridMaxCount=0, GridMinCount=16, JaggedSeams=False, MaxEdgeLength=0, MinEdgeLength=0.0001, MinTolerance=0, Refine=True, RefineAngle=0, RelativeTolerance=0.65, SimplePlanes=True, Tolerance=0})
mesh_join_13 = MeshJoin(Meshes=flatten(mesh_brep_13))
mesh_join_14 = MeshJoin(Meshes=flatten(mesh_brep_14))
mesh_join_15 = MeshJoin(Meshes=flatten(mesh_brep_15))
reduce_mesh_5 = ReduceMesh(Mesh=mesh_join_15, FaceCount=20, Accuracy=1, FaceType=segmentacion_4, Distort=Toggle(False), Normalize=Toggle(True))  # -> Reduced, CountDifference
panel_6 = Panel(reduce_mesh_5.CountDifference)
python_3_script_23 = Python3Script(M=mesh_join_14, B=rh_in_09_0_mapeado)  # -> a; inputs M: Mesh, B: list of Int32; same code as python_3_script_11
python_3_script_24 = Python3Script(M=reduce_mesh_5.Reduced, B=rh_in_09_0_mapeado)  # -> a; inputs M: Mesh, B: list of Int32; same code as python_3_script_11
rh_out_mdf_fondos_de_cajon = Geometry(python_3_script_24)
rh_out_fondos_de_cajon_b = Geometry(python_3_script_23)

# Box Mapping 3.8
python_3_script_25 = Python3Script(M=mesh_join_13, B=rh_in_09_0_mapeado)  # -> a; inputs M: Mesh, B: list of Int32; same code as python_3_script_11

rh_out_fondos_de_cajon = Geometry(python_3_script_25)

# ---- group: Tapaluces IZ (continued)
diagnostico_6 = Panel(python_3_script_8.Out)
mesh_brep_16 = MeshBrep(
    Brep=python_3_script_8.NURBS_Color,
    Settings={GridMaxCount=0, GridMinCount=16, JaggedSeams=False, MaxEdgeLength=0, MinEdgeLength=0.0001, MinTolerance=0, Refine=True, RefineAngle=0, RelativeTolerance=0.65, SimplePlanes=True, Tolerance=0})
mesh_brep_17 = MeshBrep(
    Brep=python_3_script_8.NURBS_Balance,
    Settings={GridMaxCount=0, GridMinCount=16, JaggedSeams=False, MaxEdgeLength=0, MinEdgeLength=0.0001, MinTolerance=0, Refine=True, RefineAngle=0, RelativeTolerance=0.65, SimplePlanes=True, Tolerance=0})
mesh_brep_18 = MeshBrep(
    Brep=python_3_script_8.NURBS_MDP,
    Settings={GridMaxCount=0, GridMinCount=16, JaggedSeams=False, MaxEdgeLength=0, MinEdgeLength=0.0001, MinTolerance=0, Refine=True, RefineAngle=0, RelativeTolerance=0.65, SimplePlanes=True, Tolerance=0})
mesh_join_16 = MeshJoin(Meshes=flatten(mesh_brep_16))
mesh_join_17 = MeshJoin(Meshes=flatten(mesh_brep_17))
mesh_join_18 = MeshJoin(Meshes=flatten(mesh_brep_18))
reduce_mesh_6 = ReduceMesh(Mesh=mesh_join_18, FaceCount=20, Accuracy=1, FaceType=segmentacion_7, Distort=Toggle(False), Normalize=Toggle(True))  # -> Reduced, CountDifference
panel_7 = Panel(reduce_mesh_6.CountDifference)
python_3_script_26 = Python3Script(M=reduce_mesh_6.Reduced, B=rh_in_04_0_mapeado)  # -> a; inputs M: Mesh, B: list of Int32; same code as python_3_script_11
python_3_script_27 = Python3Script(M=mesh_join_17, B=rh_in_04_0_mapeado)  # -> a; inputs M: Mesh, B: list of Int32; same code as python_3_script_11
rh_out_mdp_tapaluz = Geometry(python_3_script_26)
rh_out_tapaluz_b = Geometry(python_3_script_27)

# ----
# Box Mapping 3.8
python_3_script_28 = Python3Script(M=mesh_join_16, B=rh_in_04_0_mapeado)  # -> a; inputs M: Mesh, B: list of Int32; same code as python_3_script_11

# ---- group: Tapaluces IZ (continued)
rh_out_tapaluz = Geometry(python_3_script_28)

# ---- group: Espaldares (continued)
diagnostico_7 = Panel(python_3_script_7.Out)
mesh_brep_19 = MeshBrep(
    Brep=python_3_script_7.NURBS_Color,
    Settings={GridMaxCount=0, GridMinCount=16, JaggedSeams=False, MaxEdgeLength=0, MinEdgeLength=0.0001, MinTolerance=0, Refine=True, RefineAngle=0, RelativeTolerance=0.65, SimplePlanes=True, Tolerance=0})
mesh_brep_20 = MeshBrep(
    Brep=python_3_script_7.NURBS_Balance,
    Settings={GridMaxCount=0, GridMinCount=16, JaggedSeams=False, MaxEdgeLength=0, MinEdgeLength=0.0001, MinTolerance=0, Refine=True, RefineAngle=0, RelativeTolerance=0.65, SimplePlanes=True, Tolerance=0})
mesh_brep_21 = MeshBrep(
    Brep=python_3_script_7.NURBS_MDP,
    Settings={GridMaxCount=0, GridMinCount=16, JaggedSeams=False, MaxEdgeLength=0, MinEdgeLength=0.0001, MinTolerance=0, Refine=True, RefineAngle=0, RelativeTolerance=0.65, SimplePlanes=True, Tolerance=0})
mesh_join_19 = MeshJoin(Meshes=flatten(mesh_brep_19))
mesh_join_20 = MeshJoin(Meshes=flatten(mesh_brep_20))
mesh_join_21 = MeshJoin(Meshes=flatten(mesh_brep_21))
reduce_mesh_7 = ReduceMesh(Mesh=mesh_join_21, FaceCount=20, Accuracy=1, FaceType=segmentacion_6, Distort=Toggle(False), Normalize=Toggle(True))  # -> Reduced, CountDifference
panel_8 = Panel(reduce_mesh_7.CountDifference)
python_3_script_29 = Python3Script(M=mesh_join_20, B=rh_in_10_0_mapeado)  # -> a; inputs M: Mesh, B: list of Int32; same code as python_3_script_11
python_3_script_30 = Python3Script(M=reduce_mesh_7.Reduced, B=rh_in_10_0_mapeado)  # -> a; inputs M: Mesh, B: list of Int32; same code as python_3_script_11
rh_out_mdf_espaldares = Geometry(python_3_script_30)
rh_out_espaldares_b = Geometry(python_3_script_29)

# Box Mapping 3.8
python_3_script_31 = Python3Script(M=mesh_join_19, B=rh_in_10_0_mapeado)  # -> a; inputs M: Mesh, B: list of Int32; same code as python_3_script_11

rh_out_espaldares = Geometry(python_3_script_31)

# ---- group: Posterior de Cajon (continued)
diagnostico_8 = Panel(python_3_script_9.Out)
mesh_brep_22 = MeshBrep(
    Brep=python_3_script_9.NURBS_Color,
    Settings={GridMaxCount=0, GridMinCount=16, JaggedSeams=False, MaxEdgeLength=0, MinEdgeLength=0.0001, MinTolerance=0, Refine=True, RefineAngle=0, RelativeTolerance=0.65, SimplePlanes=True, Tolerance=0})
mesh_brep_23 = MeshBrep(
    Brep=python_3_script_9.NURBS_Balance,
    Settings={GridMaxCount=0, GridMinCount=16, JaggedSeams=False, MaxEdgeLength=0, MinEdgeLength=0.0001, MinTolerance=0, Refine=True, RefineAngle=0, RelativeTolerance=0.65, SimplePlanes=True, Tolerance=0})
mesh_brep_24 = MeshBrep(
    Brep=python_3_script_9.NURBS_MDP,
    Settings={GridMaxCount=0, GridMinCount=16, JaggedSeams=False, MaxEdgeLength=0, MinEdgeLength=0.0001, MinTolerance=0, Refine=True, RefineAngle=0, RelativeTolerance=0.65, SimplePlanes=True, Tolerance=0})
mesh_join_22 = MeshJoin(Meshes=flatten(mesh_brep_22))
mesh_join_23 = MeshJoin(Meshes=flatten(mesh_brep_23))
mesh_join_24 = MeshJoin(Meshes=flatten(mesh_brep_24))
reduce_mesh_8 = ReduceMesh(Mesh=mesh_join_24, FaceCount=20, Accuracy=1, FaceType=segmentacion_8, Distort=Toggle(False), Normalize=Toggle(True))  # -> Reduced, CountDifference
panel_9 = Panel(reduce_mesh_8.CountDifference)
python_3_script_32 = Python3Script(M=reduce_mesh_8.Reduced, B=rh_in_07_0_mapeado)  # -> a; inputs M: Mesh, B: list of Int32; same code as python_3_script_11
python_3_script_33 = Python3Script(M=mesh_join_23, B=rh_in_07_0_mapeado)  # -> a; inputs M: Mesh, B: list of Int32; same code as python_3_script_11
rh_out_mdp_posterior_de_cajon = Geometry(python_3_script_32)
rh_out_posterior_de_cajon_b = Geometry(python_3_script_33)

# Box Mapping 3.8
python_3_script_34 = Python3Script(M=mesh_join_22, B=rh_in_07_0_mapeado)  # -> a; inputs M: Mesh, B: list of Int32; same code as python_3_script_11

rh_out_posterior_de_cajon = Geometry(python_3_script_34)

# ---- group: Laterales de Cajon (continued)
diagnostico_9 = Panel(python_3_script_10.Out)
mesh_brep_25 = MeshBrep(
    Brep=python_3_script_10.NURBS_Color,
    Settings={GridMaxCount=0, GridMinCount=16, JaggedSeams=False, MaxEdgeLength=0, MinEdgeLength=0.0001, MinTolerance=0, Refine=True, RefineAngle=0, RelativeTolerance=0.65, SimplePlanes=True, Tolerance=0})
mesh_brep_26 = MeshBrep(
    Brep=python_3_script_10.NURBS_Balance,
    Settings={GridMaxCount=0, GridMinCount=16, JaggedSeams=False, MaxEdgeLength=0, MinEdgeLength=0.0001, MinTolerance=0, Refine=True, RefineAngle=0, RelativeTolerance=0.65, SimplePlanes=True, Tolerance=0})
mesh_brep_27 = MeshBrep(
    Brep=python_3_script_10.NURBS_MDP,
    Settings={GridMaxCount=0, GridMinCount=16, JaggedSeams=False, MaxEdgeLength=0, MinEdgeLength=0.0001, MinTolerance=0, Refine=True, RefineAngle=0, RelativeTolerance=0.65, SimplePlanes=True, Tolerance=0})
mesh_join_25 = MeshJoin(Meshes=flatten(mesh_brep_25))
mesh_join_26 = MeshJoin(Meshes=flatten(mesh_brep_26))
mesh_join_27 = MeshJoin(Meshes=flatten(mesh_brep_27))
reduce_mesh_9 = ReduceMesh(Mesh=mesh_join_27, FaceCount=20, Accuracy=1, FaceType=segmentacion_9, Distort=Toggle(False), Normalize=Toggle(True))  # -> Reduced, CountDifference
panel_10 = Panel(reduce_mesh_9.CountDifference)
python_3_script_35 = Python3Script(M=reduce_mesh_9.Reduced, B=rh_in_06_0_mapeado)  # -> a; inputs M: Mesh, B: list of Int32; same code as python_3_script_11
python_3_script_36 = Python3Script(M=mesh_join_26, B=rh_in_06_0_mapeado)  # -> a; inputs M: Mesh, B: list of Int32; same code as python_3_script_11
rh_out_mdp_laterales_de_cajon = Geometry(python_3_script_35)
rh_out_laterales_de_cajon_b = Geometry(python_3_script_36)

# Box Mapping 3.8
python_3_script_37 = Python3Script(M=mesh_join_25, B=rh_in_06_0_mapeado)  # -> a; inputs M: Mesh, B: list of Int32; same code as python_3_script_11

rh_out_laterales_de_cajon = Geometry(python_3_script_37)

# ---- group: Zocalo Posterior
rh_in_14_1_lado_balance = ValueList({"Cara A", "Cara B", "D/D"}, selected="Cara B")
rh_in_14_2_canto_frontal = ValueList({"Canto": 0, "MDP": 1}, selected="MDP")
rh_in_14_3_canto_trasero = ValueList({"Canto": 0, "MDP": 1}, selected="MDP")
rh_in_14_4canto_izquierdo_arriba = ValueList({"Canto": 0, "MDP": 1}, selected="MDP")
rh_in_14_5_canto_derecho_abajo = ValueList({"Canto": 0, "MDP": 1}, selected="MDP")
segmentacion_10 = ValueList({"Triángulos": 0, "Quads y triángulos (mixto)": 1, "Sólo quads si es posible": 2}, selected="Sólo quads si es posible")
rh_in_14_0_mapeado = ValueList({"Longitudinal": 0, "Atravesada": 1}, selected="Longitudinal")

# Materializer 3.4
python_3_script_38 = Python3Script(
    Brep_In=brep_10,
    Balance_Mode=rh_in_14_1_lado_balance,
    Canto_1=rh_in_14_2_canto_frontal,
    Canto_2=rh_in_14_3_canto_trasero,
    Canto_3=rh_in_14_4canto_izquierdo_arriba,
    Canto_4=rh_in_14_5_canto_derecho_abajo)  # -> Out, NURBS_Color, NURBS_Balance, NURBS_MDP; inputs Brep_In: list of Brep, Balance_Mode: String, Canto_1: String, Canto_2: String, Canto_3: String, Canto_4: String; same code as python_3_script_2

# ---- group: Tapaluces Der
rh_in_11_1_lado_balance = ValueList({"Cara A", "Cara B", "D/D"}, selected="Cara B")
rh_in_11_2_canto_frontal = ValueList({"Canto": 0, "MDP": 1}, selected="MDP")
rh_in_11_3_canto_trasero = ValueList({"Canto": 0, "MDP": 1}, selected="MDP")
rh_in_11_4canto_izquierdo_arriba = ValueList({"Canto": 0, "MDP": 1}, selected="MDP")
rh_in_11_5_canto_derecho_abajo = ValueList({"Canto": 0, "MDP": 1}, selected="MDP")
segmentacion_11 = ValueList({"Triángulos": 0, "Quads y triángulos (mixto)": 1, "Sólo quads si es posible": 2}, selected="Sólo quads si es posible")
rh_in_11_0_mapeado = ValueList({"Longitudinal": 0, "Atravesada": 1}, selected="Longitudinal")

# Materializer 3.4
python_3_script_39 = Python3Script(
    Brep_In=brep_11,
    Balance_Mode=rh_in_11_1_lado_balance,
    Canto_1=rh_in_11_2_canto_frontal,
    Canto_2=rh_in_11_3_canto_trasero,
    Canto_3=rh_in_11_4canto_izquierdo_arriba,
    Canto_4=rh_in_11_5_canto_derecho_abajo)  # -> Out, NURBS_Color, NURBS_Balance, NURBS_MDP; inputs Brep_In: list of Brep, Balance_Mode: String, Canto_1: String, Canto_2: String, Canto_3: String, Canto_4: String; same code as python_3_script_2

# ---- group: Costado Izquierdo
rh_in_12_1_lado_balance = ValueList({"Cara A", "Cara B", "D/D"}, selected="Cara B")
rh_in_12_2_canto_frontal = ValueList({"Canto": 0, "MDP": 1}, selected="MDP")
rh_in_12_4canto_izquierdo_arriba = ValueList({"Canto": 0, "MDP": 1}, selected="MDP")
rh_in_12_5_canto_derecho_abajo = ValueList({"Canto": 0, "MDP": 1}, selected="MDP")
rh_in_12_3_canto_trasero = ValueList({"Canto": 0, "MDP": 1}, selected="MDP")
segmentacion_12 = ValueList({"Triángulos": 0, "Quads y triángulos (mixto)": 1, "Sólo quads si es posible": 2}, selected="Sólo quads si es posible")
rh_in_12_0_mapeado = ValueList({"Longitudinal": 0, "Atravesada": 1}, selected="Longitudinal")

# Materializer 3.4
python_3_script_40 = Python3Script(
    Brep_In=brep_12,
    Balance_Mode=rh_in_12_1_lado_balance,
    Canto_1=rh_in_12_2_canto_frontal,
    Canto_2=rh_in_12_3_canto_trasero,
    Canto_3=rh_in_12_4canto_izquierdo_arriba,
    Canto_4=rh_in_12_5_canto_derecho_abajo)  # -> Out, NURBS_Color, NURBS_Balance, NURBS_MDP; inputs Brep_In: list of Brep, Balance_Mode: String, Canto_1: String, Canto_2: String, Canto_3: String, Canto_4: String; same code as python_3_script_2

# ---- group: Paral Central
rh_in_13_1_lado_balance = ValueList({"Cara A", "Cara B", "D/D"}, selected="Cara B")
rh_in_13_2_canto_frontal = ValueList({"Canto": 0, "MDP": 1}, selected="MDP")
rh_in_13_4canto_izquierdo_arriba = ValueList({"Canto": 0, "MDP": 1}, selected="MDP")
rh_in_13_5_canto_derecho_abajo = ValueList({"Canto": 0, "MDP": 1}, selected="MDP")
rh_in_13_3_canto_trasero = ValueList({"Canto": 0, "MDP": 1}, selected="MDP")
segmentacion_13 = ValueList({"Triángulos": 0, "Quads y triángulos (mixto)": 1, "Sólo quads si es posible": 2}, selected="Sólo quads si es posible")
rh_in_13_0_mapeado = ValueList({"Longitudinal": 0, "Atravesada": 1}, selected="Longitudinal")

# Materializer 3.4
python_3_script_41 = Python3Script(
    Brep_In=brep_13,
    Balance_Mode=rh_in_13_1_lado_balance,
    Canto_1=rh_in_13_2_canto_frontal,
    Canto_2=rh_in_13_3_canto_trasero,
    Canto_3=rh_in_13_4canto_izquierdo_arriba,
    Canto_4=rh_in_13_5_canto_derecho_abajo)  # -> Out, NURBS_Color, NURBS_Balance, NURBS_MDP; inputs Brep_In: list of Brep, Balance_Mode: String, Canto_1: String, Canto_2: String, Canto_3: String, Canto_4: String; same code as python_3_script_2

# ---- group: Zocalo Posterior (continued)
diagnostico_10 = Panel(python_3_script_38.Out)
mesh_brep_28 = MeshBrep(
    Brep=python_3_script_38.NURBS_Color,
    Settings={GridMaxCount=0, GridMinCount=16, JaggedSeams=False, MaxEdgeLength=0, MinEdgeLength=0.0001, MinTolerance=0, Refine=True, RefineAngle=0, RelativeTolerance=0.65, SimplePlanes=True, Tolerance=0})
mesh_brep_29 = MeshBrep(
    Brep=python_3_script_38.NURBS_Balance,
    Settings={GridMaxCount=0, GridMinCount=16, JaggedSeams=False, MaxEdgeLength=0, MinEdgeLength=0.0001, MinTolerance=0, Refine=True, RefineAngle=0, RelativeTolerance=0.65, SimplePlanes=True, Tolerance=0})
mesh_brep_30 = MeshBrep(
    Brep=python_3_script_38.NURBS_MDP,
    Settings={GridMaxCount=0, GridMinCount=16, JaggedSeams=False, MaxEdgeLength=0, MinEdgeLength=0.0001, MinTolerance=0, Refine=True, RefineAngle=0, RelativeTolerance=0.65, SimplePlanes=True, Tolerance=0})
mesh_join_28 = MeshJoin(Meshes=flatten(mesh_brep_28))
mesh_join_29 = MeshJoin(Meshes=flatten(mesh_brep_29))
mesh_join_30 = MeshJoin(Meshes=flatten(mesh_brep_30))
reduce_mesh_10 = ReduceMesh(Mesh=mesh_join_30, FaceCount=20, Accuracy=1, FaceType=segmentacion_10, Distort=Toggle(False), Normalize=Toggle(True))  # -> Reduced, CountDifference
panel_11 = Panel(reduce_mesh_10.CountDifference)
python_3_script_42 = Python3Script(M=reduce_mesh_10.Reduced, B=rh_in_14_0_mapeado)  # -> a; inputs M: Mesh, B: list of Int32; same code as python_3_script_11
python_3_script_43 = Python3Script(M=mesh_join_29, B=rh_in_14_0_mapeado)  # -> a; inputs M: Mesh, B: list of Int32; same code as python_3_script_11
rh_out_mdp_zocalo_posterior = Geometry(python_3_script_42)
rh_out_zocalo_posterior_b = Geometry(python_3_script_43)

# ----
# Box Mapping 3.8
python_3_script_44 = Python3Script(M=mesh_join_28, B=rh_in_14_0_mapeado)  # -> a; inputs M: Mesh, B: list of Int32; same code as python_3_script_11

# ---- group: Zocalo Posterior (continued)
rh_out_zocalo_posterior = Geometry(python_3_script_44)

# ---- group: Tapaluces Der (continued)
diagnostico_11 = Panel(python_3_script_39.Out)
mesh_brep_31 = MeshBrep(
    Brep=python_3_script_39.NURBS_Color,
    Settings={GridMaxCount=0, GridMinCount=16, JaggedSeams=False, MaxEdgeLength=0, MinEdgeLength=0.0001, MinTolerance=0, Refine=True, RefineAngle=0, RelativeTolerance=0.65, SimplePlanes=True, Tolerance=0})
mesh_brep_32 = MeshBrep(
    Brep=python_3_script_39.NURBS_Balance,
    Settings={GridMaxCount=0, GridMinCount=16, JaggedSeams=False, MaxEdgeLength=0, MinEdgeLength=0.0001, MinTolerance=0, Refine=True, RefineAngle=0, RelativeTolerance=0.65, SimplePlanes=True, Tolerance=0})
mesh_brep_33 = MeshBrep(
    Brep=python_3_script_39.NURBS_MDP,
    Settings={GridMaxCount=0, GridMinCount=16, JaggedSeams=False, MaxEdgeLength=0, MinEdgeLength=0.0001, MinTolerance=0, Refine=True, RefineAngle=0, RelativeTolerance=0.65, SimplePlanes=True, Tolerance=0})
mesh_join_31 = MeshJoin(Meshes=flatten(mesh_brep_31))
mesh_join_32 = MeshJoin(Meshes=flatten(mesh_brep_32))
mesh_join_33 = MeshJoin(Meshes=flatten(mesh_brep_33))
reduce_mesh_11 = ReduceMesh(Mesh=mesh_join_33, FaceCount=20, Accuracy=1, FaceType=segmentacion_11, Distort=Toggle(False), Normalize=Toggle(True))  # -> Reduced, CountDifference
panel_12 = Panel(reduce_mesh_11.CountDifference)
python_3_script_45 = Python3Script(M=reduce_mesh_11.Reduced, B=rh_in_11_0_mapeado)  # -> a; inputs M: Mesh, B: list of Int32; same code as python_3_script_11
python_3_script_46 = Python3Script(M=mesh_join_32, B=rh_in_11_0_mapeado)  # -> a; inputs M: Mesh, B: list of Int32; same code as python_3_script_11
rh_out_mdp_tapaluz_der = Geometry(python_3_script_45)
rh_out_tapaluz_der_b = Geometry(python_3_script_46)

# ----
# Box Mapping 3.8
python_3_script_47 = Python3Script(M=mesh_join_31, B=rh_in_11_0_mapeado)  # -> a; inputs M: Mesh, B: list of Int32; same code as python_3_script_11

# ---- group: Tapaluces Der (continued)
rh_out_tapaluz_der = Geometry(python_3_script_47)

# ---- group: Costado Izquierdo (continued)
diagnostico_12 = Panel(python_3_script_40.Out)
mesh_brep_34 = MeshBrep(
    Brep=python_3_script_40.NURBS_Color,
    Settings={GridMaxCount=0, GridMinCount=16, JaggedSeams=False, MaxEdgeLength=0, MinEdgeLength=0.0001, MinTolerance=0, Refine=True, RefineAngle=0, RelativeTolerance=0.65, SimplePlanes=True, Tolerance=0})
mesh_brep_35 = MeshBrep(
    Brep=python_3_script_40.NURBS_Balance,
    Settings={GridMaxCount=0, GridMinCount=16, JaggedSeams=False, MaxEdgeLength=0, MinEdgeLength=0.0001, MinTolerance=0, Refine=True, RefineAngle=0, RelativeTolerance=0.65, SimplePlanes=True, Tolerance=0})
mesh_brep_36 = MeshBrep(
    Brep=python_3_script_40.NURBS_MDP,
    Settings={GridMaxCount=0, GridMinCount=16, JaggedSeams=False, MaxEdgeLength=0, MinEdgeLength=0.0001, MinTolerance=0, Refine=True, RefineAngle=0, RelativeTolerance=0.65, SimplePlanes=True, Tolerance=0})
mesh_join_34 = MeshJoin(Meshes=flatten(mesh_brep_34))
mesh_join_35 = MeshJoin(Meshes=flatten(mesh_brep_35))
mesh_join_36 = MeshJoin(Meshes=flatten(mesh_brep_36))
reduce_mesh_12 = ReduceMesh(Mesh=mesh_join_36, FaceCount=20, Accuracy=1, FaceType=segmentacion_12, Distort=Toggle(False), Normalize=Toggle(True))  # -> Reduced, CountDifference
panel_13 = Panel(reduce_mesh_12.CountDifference)
python_3_script_48 = Python3Script(M=reduce_mesh_12.Reduced, B=rh_in_12_0_mapeado)  # -> a; inputs M: Mesh, B: list of Int32; same code as python_3_script_11
python_3_script_49 = Python3Script(M=mesh_join_35, B=rh_in_12_0_mapeado)  # -> a; inputs M: Mesh, B: list of Int32; same code as python_3_script_11
rh_out_mdp_costado_izquierdo = Geometry(python_3_script_48)
rh_out_costado_izquierdo_b = Geometry(python_3_script_49)

# ----
# Box Mapping 3.8
python_3_script_50 = Python3Script(M=mesh_join_34, B=rh_in_12_0_mapeado)  # -> a; inputs M: Mesh, B: list of Int32; same code as python_3_script_11

# ---- group: Costado Izquierdo (continued)
rh_out_costado_izquierdo = Geometry(python_3_script_50)

# ---- group: Paral Central (continued)
diagnostico_13 = Panel(python_3_script_41.Out)
mesh_brep_37 = MeshBrep(
    Brep=python_3_script_41.NURBS_Color,
    Settings={GridMaxCount=0, GridMinCount=16, JaggedSeams=False, MaxEdgeLength=0, MinEdgeLength=0.0001, MinTolerance=0, Refine=True, RefineAngle=0, RelativeTolerance=0.65, SimplePlanes=True, Tolerance=0})
mesh_brep_38 = MeshBrep(
    Brep=python_3_script_41.NURBS_Balance,
    Settings={GridMaxCount=0, GridMinCount=16, JaggedSeams=False, MaxEdgeLength=0, MinEdgeLength=0.0001, MinTolerance=0, Refine=True, RefineAngle=0, RelativeTolerance=0.65, SimplePlanes=True, Tolerance=0})
mesh_brep_39 = MeshBrep(
    Brep=python_3_script_41.NURBS_MDP,
    Settings={GridMaxCount=0, GridMinCount=16, JaggedSeams=False, MaxEdgeLength=0, MinEdgeLength=0.0001, MinTolerance=0, Refine=True, RefineAngle=0, RelativeTolerance=0.65, SimplePlanes=True, Tolerance=0})
mesh_join_37 = MeshJoin(Meshes=flatten(mesh_brep_37))
mesh_join_38 = MeshJoin(Meshes=flatten(mesh_brep_38))
mesh_join_39 = MeshJoin(Meshes=flatten(mesh_brep_39))
reduce_mesh_13 = ReduceMesh(Mesh=mesh_join_39, FaceCount=20, Accuracy=1, FaceType=segmentacion_13, Distort=Toggle(False), Normalize=Toggle(True))  # -> Reduced, CountDifference
panel_14 = Panel(reduce_mesh_13.CountDifference)
python_3_script_51 = Python3Script(M=reduce_mesh_13.Reduced, B=rh_in_13_0_mapeado)  # -> a; inputs M: Mesh, B: list of Int32; same code as python_3_script_11
python_3_script_52 = Python3Script(M=mesh_join_38, B=rh_in_13_0_mapeado)  # -> a; inputs M: Mesh, B: list of Int32; same code as python_3_script_11
rh_out_mdp_paral_central = Geometry(python_3_script_51)
rh_out_paral_central_b = Geometry(python_3_script_52)

# ----
# Box Mapping 3.8
python_3_script_53 = Python3Script(M=mesh_join_37, B=rh_in_13_0_mapeado)  # -> a; inputs M: Mesh, B: list of Int32; same code as python_3_script_11

# ---- group: Paral Central (continued)
rh_out_paral_central = Geometry(python_3_script_53)

# ---- group: Sobre Zocalo F
rh_in_15_1_lado_balance = ValueList({"Cara A", "Cara B", "D/D"}, selected="Cara B")
rh_in_15_2_canto_frontal = ValueList({"Canto": 0, "MDP": 1}, selected="MDP")
rh_in_15_3_canto_trasero = ValueList({"Canto": 0, "MDP": 1}, selected="MDP")
rh_in_15_4canto_izquierdo_arriba = ValueList({"Canto": 0, "MDP": 1}, selected="MDP")
rh_in_15_5_canto_derecho_abajo = ValueList({"Canto": 0, "MDP": 1}, selected="MDP")
segmentacion_14 = ValueList({"Triángulos": 0, "Quads y triángulos (mixto)": 1, "Sólo quads si es posible": 2}, selected="Sólo quads si es posible")
rh_in_15_0_mapeado = ValueList({"Longitudinal": 0, "Atravesada": 1}, selected="Longitudinal")

# Materializer 3.4
python_3_script_54 = Python3Script(
    Brep_In=brep_14,
    Balance_Mode=rh_in_15_1_lado_balance,
    Canto_1=rh_in_15_2_canto_frontal,
    Canto_2=rh_in_15_3_canto_trasero,
    Canto_3=rh_in_15_4canto_izquierdo_arriba,
    Canto_4=rh_in_15_5_canto_derecho_abajo)  # -> Out, NURBS_Color, NURBS_Balance, NURBS_MDP; inputs Brep_In: list of Brep, Balance_Mode: String, Canto_1: String, Canto_2: String, Canto_3: String, Canto_4: String; same code as python_3_script_2

# ---- group: Reenguece Izq
rh_in_20_1_lado_balance = ValueList({"Cara A", "Cara B", "D/D"}, selected="Cara B")
rh_in_20_2_canto_frontal = ValueList({"Canto": 0, "MDP": 1}, selected="MDP")
rh_in_20_3_canto_trasero = ValueList({"Canto": 0, "MDP": 1}, selected="MDP")
rh_in_20_4canto_izquierdo_arriba = ValueList({"Canto": 0, "MDP": 1}, selected="MDP")
rh_in_20_5_canto_derecho_abajo = ValueList({"Canto": 0, "MDP": 1}, selected="MDP")
segmentacion_15 = ValueList({"Triángulos": 0, "Quads y triángulos (mixto)": 1, "Sólo quads si es posible": 2}, selected="Sólo quads si es posible")
rh_in_20_0_mapeado = ValueList({"Longitudinal": 0, "Atravesada": 1}, selected="Longitudinal")

# Materializer 3.4
python_3_script_55 = Python3Script(
    Brep_In=brep_15,
    Balance_Mode=rh_in_20_1_lado_balance,
    Canto_1=rh_in_20_2_canto_frontal,
    Canto_2=rh_in_20_3_canto_trasero,
    Canto_3=rh_in_20_4canto_izquierdo_arriba,
    Canto_4=rh_in_20_5_canto_derecho_abajo)  # -> Out, NURBS_Color, NURBS_Balance, NURBS_MDP; inputs Brep_In: list of Brep, Balance_Mode: String, Canto_1: String, Canto_2: String, Canto_3: String, Canto_4: String; same code as python_3_script_2

# ---- group: Refuerzao Zocalo
rh_in_19_1_lado_balance = ValueList({"Cara A", "Cara B", "D/D"}, selected="Cara B")
rh_in_19_2_canto_frontal = ValueList({"Canto": 0, "MDP": 1}, selected="MDP")
rh_in_19_3_canto_trasero = ValueList({"Canto": 0, "MDP": 1}, selected="MDP")
rh_in_19_4canto_izquierdo_arriba = ValueList({"Canto": 0, "MDP": 1}, selected="MDP")
rh_in_19_5_canto_derecho_abajo = ValueList({"Canto": 0, "MDP": 1}, selected="MDP")
segmentacion_16 = ValueList({"Triángulos": 0, "Quads y triángulos (mixto)": 1, "Sólo quads si es posible": 2}, selected="Sólo quads si es posible")
rh_in_19_0_mapeado = ValueList({"Longitudinal": 0, "Atravesada": 1}, selected="Longitudinal")

# Materializer 3.4
python_3_script_56 = Python3Script(
    Brep_In=brep_16,
    Balance_Mode=rh_in_19_1_lado_balance,
    Canto_1=rh_in_19_2_canto_frontal,
    Canto_2=rh_in_19_3_canto_trasero,
    Canto_3=rh_in_19_4canto_izquierdo_arriba,
    Canto_4=rh_in_19_5_canto_derecho_abajo)  # -> Out, NURBS_Color, NURBS_Balance, NURBS_MDP; inputs Brep_In: list of Brep, Balance_Mode: String, Canto_1: String, Canto_2: String, Canto_3: String, Canto_4: String; same code as python_3_script_2

# ---- group: Refuerzo Posterior Izq
rh_in_17_1_lado_balance = ValueList({"Cara A", "Cara B", "D/D"}, selected="Cara B")
rh_in_17_2_canto_frontal = ValueList({"Canto": 0, "MDP": 1}, selected="MDP")
rh_in_17_3_canto_trasero = ValueList({"Canto": 0, "MDP": 1}, selected="MDP")
rh_in_17_4canto_izquierdo_arriba = ValueList({"Canto": 0, "MDP": 1}, selected="MDP")
rh_in_17_5_canto_derecho_abajo = ValueList({"Canto": 0, "MDP": 1}, selected="MDP")
segmentacion_17 = ValueList({"Triángulos": 0, "Quads y triángulos (mixto)": 1, "Sólo quads si es posible": 2}, selected="Sólo quads si es posible")
rh_in_17_0_mapeado = ValueList({"Longitudinal": 0, "Atravesada": 1}, selected="Longitudinal")

# Materializer 3.4
python_3_script_57 = Python3Script(
    Brep_In=brep_17,
    Balance_Mode=rh_in_17_1_lado_balance,
    Canto_1=rh_in_17_2_canto_frontal,
    Canto_2=rh_in_17_3_canto_trasero,
    Canto_3=rh_in_17_4canto_izquierdo_arriba,
    Canto_4=rh_in_17_5_canto_derecho_abajo)  # -> Out, NURBS_Color, NURBS_Balance, NURBS_MDP; inputs Brep_In: list of Brep, Balance_Mode: String, Canto_1: String, Canto_2: String, Canto_3: String, Canto_4: String; same code as python_3_script_2

# ---- group: Sobre Zocalo F (continued)
diagnostico_14 = Panel(python_3_script_54.Out)
mesh_brep_40 = MeshBrep(
    Brep=python_3_script_54.NURBS_Color,
    Settings={GridMaxCount=0, GridMinCount=16, JaggedSeams=False, MaxEdgeLength=0, MinEdgeLength=0.0001, MinTolerance=0, Refine=True, RefineAngle=0, RelativeTolerance=0.65, SimplePlanes=True, Tolerance=0})
mesh_brep_41 = MeshBrep(
    Brep=python_3_script_54.NURBS_Balance,
    Settings={GridMaxCount=0, GridMinCount=16, JaggedSeams=False, MaxEdgeLength=0, MinEdgeLength=0.0001, MinTolerance=0, Refine=True, RefineAngle=0, RelativeTolerance=0.65, SimplePlanes=True, Tolerance=0})
mesh_brep_42 = MeshBrep(
    Brep=python_3_script_54.NURBS_MDP,
    Settings={GridMaxCount=0, GridMinCount=16, JaggedSeams=False, MaxEdgeLength=0, MinEdgeLength=0.0001, MinTolerance=0, Refine=True, RefineAngle=0, RelativeTolerance=0.65, SimplePlanes=True, Tolerance=0})
mesh_join_40 = MeshJoin(Meshes=flatten(mesh_brep_40))
mesh_join_41 = MeshJoin(Meshes=flatten(mesh_brep_41))
mesh_join_42 = MeshJoin(Meshes=flatten(mesh_brep_42))
reduce_mesh_14 = ReduceMesh(Mesh=mesh_join_42, FaceCount=20, Accuracy=1, FaceType=segmentacion_14, Distort=Toggle(False), Normalize=Toggle(True))  # -> Reduced, CountDifference
panel_15 = Panel(reduce_mesh_14.CountDifference)
python_3_script_58 = Python3Script(M=reduce_mesh_14.Reduced, B=rh_in_15_0_mapeado)  # -> a; inputs M: Mesh, B: list of Int32; same code as python_3_script_11
python_3_script_59 = Python3Script(M=mesh_join_41, B=rh_in_15_0_mapeado)  # -> a; inputs M: Mesh, B: list of Int32; same code as python_3_script_11
rh_out_mdp_sobre_zocalo_f = Geometry(python_3_script_58)
rh_out_sobre_zocalo_f_b = Geometry(python_3_script_59)

# ----
# Box Mapping 3.8
python_3_script_60 = Python3Script(M=mesh_join_40, B=rh_in_15_0_mapeado)  # -> a; inputs M: Mesh, B: list of Int32; same code as python_3_script_11

# ---- group: Sobre Zocalo F (continued)
rh_out_sobre_zocalo_f = Geometry(python_3_script_60)

# ---- group: Reenguece Izq (continued)
diagnostico_15 = Panel(python_3_script_55.Out)
mesh_brep_43 = MeshBrep(
    Brep=python_3_script_55.NURBS_Color,
    Settings={GridMaxCount=0, GridMinCount=16, JaggedSeams=False, MaxEdgeLength=0, MinEdgeLength=0.0001, MinTolerance=0, Refine=True, RefineAngle=0, RelativeTolerance=0.65, SimplePlanes=True, Tolerance=0})
mesh_brep_44 = MeshBrep(
    Brep=python_3_script_55.NURBS_Balance,
    Settings={GridMaxCount=0, GridMinCount=16, JaggedSeams=False, MaxEdgeLength=0, MinEdgeLength=0.0001, MinTolerance=0, Refine=True, RefineAngle=0, RelativeTolerance=0.65, SimplePlanes=True, Tolerance=0})
mesh_brep_45 = MeshBrep(
    Brep=python_3_script_55.NURBS_MDP,
    Settings={GridMaxCount=0, GridMinCount=16, JaggedSeams=False, MaxEdgeLength=0, MinEdgeLength=0.0001, MinTolerance=0, Refine=True, RefineAngle=0, RelativeTolerance=0.65, SimplePlanes=True, Tolerance=0})
mesh_join_43 = MeshJoin(Meshes=flatten(mesh_brep_43))
mesh_join_44 = MeshJoin(Meshes=flatten(mesh_brep_44))
mesh_join_45 = MeshJoin(Meshes=flatten(mesh_brep_45))
reduce_mesh_15 = ReduceMesh(Mesh=mesh_join_45, FaceCount=20, Accuracy=1, FaceType=segmentacion_15, Distort=Toggle(False), Normalize=Toggle(True))  # -> Reduced, CountDifference
panel_16 = Panel(reduce_mesh_15.CountDifference)
python_3_script_61 = Python3Script(M=reduce_mesh_15.Reduced, B=rh_in_20_0_mapeado)  # -> a; inputs M: Mesh, B: list of Int32; same code as python_3_script_11
python_3_script_62 = Python3Script(M=mesh_join_44, B=rh_in_20_0_mapeado)  # -> a; inputs M: Mesh, B: list of Int32; same code as python_3_script_11
rh_out_mdp_reenguece_izq = Geometry(python_3_script_61)
rh_out_reenguece_izq_b = Geometry(python_3_script_62)

# ----
# Box Mapping 3.8
python_3_script_63 = Python3Script(M=mesh_join_43, B=rh_in_20_0_mapeado)  # -> a; inputs M: Mesh, B: list of Int32; same code as python_3_script_11

# ---- group: Reenguece Izq (continued)
rh_out_reenguece_izq = Geometry(python_3_script_63)

# ---- group: Refuerzao Zocalo (continued)
diagnostico_16 = Panel(python_3_script_56.Out)
mesh_brep_46 = MeshBrep(
    Brep=python_3_script_56.NURBS_Color,
    Settings={GridMaxCount=0, GridMinCount=16, JaggedSeams=False, MaxEdgeLength=0, MinEdgeLength=0.0001, MinTolerance=0, Refine=True, RefineAngle=0, RelativeTolerance=0.65, SimplePlanes=True, Tolerance=0})
mesh_brep_47 = MeshBrep(
    Brep=python_3_script_56.NURBS_Balance,
    Settings={GridMaxCount=0, GridMinCount=16, JaggedSeams=False, MaxEdgeLength=0, MinEdgeLength=0.0001, MinTolerance=0, Refine=True, RefineAngle=0, RelativeTolerance=0.65, SimplePlanes=True, Tolerance=0})
mesh_brep_48 = MeshBrep(
    Brep=python_3_script_56.NURBS_MDP,
    Settings={GridMaxCount=0, GridMinCount=16, JaggedSeams=False, MaxEdgeLength=0, MinEdgeLength=0.0001, MinTolerance=0, Refine=True, RefineAngle=0, RelativeTolerance=0.65, SimplePlanes=True, Tolerance=0})
mesh_join_46 = MeshJoin(Meshes=flatten(mesh_brep_46))
mesh_join_47 = MeshJoin(Meshes=flatten(mesh_brep_47))
mesh_join_48 = MeshJoin(Meshes=flatten(mesh_brep_48))
reduce_mesh_16 = ReduceMesh(Mesh=mesh_join_48, FaceCount=20, Accuracy=1, FaceType=segmentacion_16, Distort=Toggle(False), Normalize=Toggle(True))  # -> Reduced, CountDifference
panel_17 = Panel(reduce_mesh_16.CountDifference)
python_3_script_64 = Python3Script(M=reduce_mesh_16.Reduced, B=rh_in_19_0_mapeado)  # -> a; inputs M: Mesh, B: list of Int32; same code as python_3_script_11
python_3_script_65 = Python3Script(M=mesh_join_47, B=rh_in_19_0_mapeado)  # -> a; inputs M: Mesh, B: list of Int32; same code as python_3_script_11
rh_out_mdp_refuerzao_zocalo = Geometry(python_3_script_64)
rh_out_refuerzao_zocalo_b = Geometry(python_3_script_65)

# ----
# Box Mapping 3.8
python_3_script_66 = Python3Script(M=mesh_join_46, B=rh_in_19_0_mapeado)  # -> a; inputs M: Mesh, B: list of Int32; same code as python_3_script_11

# ---- group: Refuerzao Zocalo (continued)
rh_out_refuerzao_zocalo = Geometry(python_3_script_66)

# ---- group: Refuerzo Posterior Izq (continued)
diagnostico_17 = Panel(python_3_script_57.Out)
mesh_brep_49 = MeshBrep(
    Brep=python_3_script_57.NURBS_Color,
    Settings={GridMaxCount=0, GridMinCount=16, JaggedSeams=False, MaxEdgeLength=0, MinEdgeLength=0.0001, MinTolerance=0, Refine=True, RefineAngle=0, RelativeTolerance=0.65, SimplePlanes=True, Tolerance=0})
mesh_brep_50 = MeshBrep(
    Brep=python_3_script_57.NURBS_Balance,
    Settings={GridMaxCount=0, GridMinCount=16, JaggedSeams=False, MaxEdgeLength=0, MinEdgeLength=0.0001, MinTolerance=0, Refine=True, RefineAngle=0, RelativeTolerance=0.65, SimplePlanes=True, Tolerance=0})
mesh_brep_51 = MeshBrep(
    Brep=python_3_script_57.NURBS_MDP,
    Settings={GridMaxCount=0, GridMinCount=16, JaggedSeams=False, MaxEdgeLength=0, MinEdgeLength=0.0001, MinTolerance=0, Refine=True, RefineAngle=0, RelativeTolerance=0.65, SimplePlanes=True, Tolerance=0})
mesh_join_49 = MeshJoin(Meshes=flatten(mesh_brep_49))
mesh_join_50 = MeshJoin(Meshes=flatten(mesh_brep_50))
mesh_join_51 = MeshJoin(Meshes=flatten(mesh_brep_51))
reduce_mesh_17 = ReduceMesh(Mesh=mesh_join_51, FaceCount=20, Accuracy=1, FaceType=segmentacion_17, Distort=Toggle(False), Normalize=Toggle(True))  # -> Reduced, CountDifference
panel_18 = Panel(reduce_mesh_17.CountDifference)
python_3_script_67 = Python3Script(M=reduce_mesh_17.Reduced, B=rh_in_17_0_mapeado)  # -> a; inputs M: Mesh, B: list of Int32; same code as python_3_script_11
python_3_script_68 = Python3Script(M=mesh_join_50, B=rh_in_17_0_mapeado)  # -> a; inputs M: Mesh, B: list of Int32; same code as python_3_script_11
rh_out_mdp_refuerzo_posterior_izq = Geometry(python_3_script_67)
rh_out_refuerzo_posterior_izq_b = Geometry(python_3_script_68)

# ----
# Box Mapping 3.8
python_3_script_69 = Python3Script(M=mesh_join_49, B=rh_in_17_0_mapeado)  # -> a; inputs M: Mesh, B: list of Int32; same code as python_3_script_11

# ---- group: Refuerzo Posterior Izq (continued)
rh_out_refuerzo_posterior_izq = Geometry(python_3_script_69)

# ---- group: Sobre Zocalo P
rh_in_16_1_lado_balance = ValueList({"Cara A", "Cara B", "D/D"}, selected="Cara B")
rh_in_16_2_canto_frontal = ValueList({"Canto": 0, "MDP": 1}, selected="MDP")
rh_in_16_3_canto_trasero = ValueList({"Canto": 0, "MDP": 1}, selected="MDP")
rh_in_16_4canto_izquierdo_arriba = ValueList({"Canto": 0, "MDP": 1}, selected="MDP")
rh_in_16_5_canto_derecho_abajo = ValueList({"Canto": 0, "MDP": 1}, selected="MDP")
segmentacion_18 = ValueList({"Triángulos": 0, "Quads y triángulos (mixto)": 1, "Sólo quads si es posible": 2}, selected="Sólo quads si es posible")
rh_in_16_0_mapeado = ValueList({"Longitudinal": 0, "Atravesada": 1}, selected="Longitudinal")

# Materializer 3.4
python_3_script_70 = Python3Script(
    Brep_In=brep_18,
    Balance_Mode=rh_in_16_1_lado_balance,
    Canto_1=rh_in_16_2_canto_frontal,
    Canto_2=rh_in_16_3_canto_trasero,
    Canto_3=rh_in_16_4canto_izquierdo_arriba,
    Canto_4=rh_in_16_5_canto_derecho_abajo)  # -> Out, NURBS_Color, NURBS_Balance, NURBS_MDP; inputs Brep_In: list of Brep, Balance_Mode: String, Canto_1: String, Canto_2: String, Canto_3: String, Canto_4: String; same code as python_3_script_2

# ---- group: Reenguece Der
rh_in_21_1_lado_balance = ValueList({"Cara A", "Cara B", "D/D"}, selected="Cara B")
rh_in_21_2_canto_frontal = ValueList({"Canto": 0, "MDP": 1}, selected="MDP")
rh_in_21_3_canto_trasero = ValueList({"Canto": 0, "MDP": 1}, selected="MDP")
rh_in_21_5_canto_derecho_abajo = ValueList({"Canto": 0, "MDP": 1}, selected="MDP")
rh_in_21_4canto_izquierdo_arriba = ValueList({"Canto": 0, "MDP": 1}, selected="MDP")
segmentacion_19 = ValueList({"Triángulos": 0, "Quads y triángulos (mixto)": 1, "Sólo quads si es posible": 2}, selected="Sólo quads si es posible")
rh_in_21_0_mapeado = ValueList({"Longitudinal": 0, "Atravesada": 1}, selected="Longitudinal")

# Materializer 3.4
python_3_script_71 = Python3Script(
    Brep_In=brep_19,
    Balance_Mode=rh_in_21_1_lado_balance,
    Canto_1=rh_in_21_2_canto_frontal,
    Canto_2=rh_in_21_3_canto_trasero,
    Canto_3=rh_in_21_4canto_izquierdo_arriba,
    Canto_4=rh_in_21_5_canto_derecho_abajo)  # -> Out, NURBS_Color, NURBS_Balance, NURBS_MDP; inputs Brep_In: list of Brep, Balance_Mode: String, Canto_1: String, Canto_2: String, Canto_3: String, Canto_4: String; same code as python_3_script_2

# ---- group: Refuerzo Posterior Der
rh_in_18_1_lado_balance = ValueList({"Cara A", "Cara B", "D/D"}, selected="Cara B")
rh_in_18_2_canto_frontal = ValueList({"Canto": 0, "MDP": 1}, selected="MDP")
rh_in_18_3_canto_trasero = ValueList({"Canto": 0, "MDP": 1}, selected="MDP")
rh_in_18_4canto_izquierdo_arriba = ValueList({"Canto": 0, "MDP": 1}, selected="MDP")
rh_in_18_5_canto_derecho_abajo = ValueList({"Canto": 0, "MDP": 1}, selected="MDP")
segmentacion_20 = ValueList({"Triángulos": 0, "Quads y triángulos (mixto)": 1, "Sólo quads si es posible": 2}, selected="Sólo quads si es posible")
rh_in_18_0_mapeado = ValueList({"Longitudinal": 0, "Atravesada": 1}, selected="Longitudinal")

# Materializer 3.4
python_3_script_72 = Python3Script(
    Brep_In=brep_20,
    Balance_Mode=rh_in_18_1_lado_balance,
    Canto_1=rh_in_18_2_canto_frontal,
    Canto_2=rh_in_18_3_canto_trasero,
    Canto_3=rh_in_18_4canto_izquierdo_arriba,
    Canto_4=rh_in_18_5_canto_derecho_abajo)  # -> Out, NURBS_Color, NURBS_Balance, NURBS_MDP; inputs Brep_In: list of Brep, Balance_Mode: String, Canto_1: String, Canto_2: String, Canto_3: String, Canto_4: String; same code as python_3_script_2

# ---- group: Sobre Zocalo P (continued)
diagnostico_18 = Panel(python_3_script_70.Out)
mesh_brep_52 = MeshBrep(
    Brep=python_3_script_70.NURBS_Color,
    Settings={GridMaxCount=0, GridMinCount=16, JaggedSeams=False, MaxEdgeLength=0, MinEdgeLength=0.0001, MinTolerance=0, Refine=True, RefineAngle=0, RelativeTolerance=0.65, SimplePlanes=True, Tolerance=0})
mesh_brep_53 = MeshBrep(
    Brep=python_3_script_70.NURBS_Balance,
    Settings={GridMaxCount=0, GridMinCount=16, JaggedSeams=False, MaxEdgeLength=0, MinEdgeLength=0.0001, MinTolerance=0, Refine=True, RefineAngle=0, RelativeTolerance=0.65, SimplePlanes=True, Tolerance=0})
mesh_brep_54 = MeshBrep(
    Brep=python_3_script_70.NURBS_MDP,
    Settings={GridMaxCount=0, GridMinCount=16, JaggedSeams=False, MaxEdgeLength=0, MinEdgeLength=0.0001, MinTolerance=0, Refine=True, RefineAngle=0, RelativeTolerance=0.65, SimplePlanes=True, Tolerance=0})
mesh_join_52 = MeshJoin(Meshes=flatten(mesh_brep_52))
mesh_join_53 = MeshJoin(Meshes=flatten(mesh_brep_53))
mesh_join_54 = MeshJoin(Meshes=flatten(mesh_brep_54))
reduce_mesh_18 = ReduceMesh(Mesh=mesh_join_54, FaceCount=20, Accuracy=1, FaceType=segmentacion_18, Distort=Toggle(False), Normalize=Toggle(True))  # -> Reduced, CountDifference
panel_19 = Panel(reduce_mesh_18.CountDifference)
python_3_script_73 = Python3Script(M=reduce_mesh_18.Reduced, B=rh_in_16_0_mapeado)  # -> a; inputs M: Mesh, B: list of Int32; same code as python_3_script_11
python_3_script_74 = Python3Script(M=mesh_join_53, B=rh_in_16_0_mapeado)  # -> a; inputs M: Mesh, B: list of Int32; same code as python_3_script_11
rh_out_mdp_sobre_zocalo_p = Geometry(python_3_script_73)
rh_out_sobre_zocalo_p_b = Geometry(python_3_script_74)

# ----
# Box Mapping 3.8
python_3_script_75 = Python3Script(M=mesh_join_52, B=rh_in_16_0_mapeado)  # -> a; inputs M: Mesh, B: list of Int32; same code as python_3_script_11

# ---- group: Sobre Zocalo P (continued)
rh_out_sobre_zocalo_p = Geometry(python_3_script_75)

# ---- group: Reenguece Der (continued)
diagnostico_19 = Panel(python_3_script_71.Out)
mesh_brep_55 = MeshBrep(
    Brep=python_3_script_71.NURBS_Color,
    Settings={GridMaxCount=0, GridMinCount=16, JaggedSeams=False, MaxEdgeLength=0, MinEdgeLength=0.0001, MinTolerance=0, Refine=True, RefineAngle=0, RelativeTolerance=0.65, SimplePlanes=True, Tolerance=0})
mesh_brep_56 = MeshBrep(
    Brep=python_3_script_71.NURBS_Balance,
    Settings={GridMaxCount=0, GridMinCount=16, JaggedSeams=False, MaxEdgeLength=0, MinEdgeLength=0.0001, MinTolerance=0, Refine=True, RefineAngle=0, RelativeTolerance=0.65, SimplePlanes=True, Tolerance=0})
mesh_brep_57 = MeshBrep(
    Brep=python_3_script_71.NURBS_MDP,
    Settings={GridMaxCount=0, GridMinCount=16, JaggedSeams=False, MaxEdgeLength=0, MinEdgeLength=0.0001, MinTolerance=0, Refine=True, RefineAngle=0, RelativeTolerance=0.65, SimplePlanes=True, Tolerance=0})
mesh_join_55 = MeshJoin(Meshes=flatten(mesh_brep_55))
mesh_join_56 = MeshJoin(Meshes=flatten(mesh_brep_56))
mesh_join_57 = MeshJoin(Meshes=flatten(mesh_brep_57))
reduce_mesh_19 = ReduceMesh(Mesh=mesh_join_57, FaceCount=20, Accuracy=1, FaceType=segmentacion_19, Distort=Toggle(False), Normalize=Toggle(True))  # -> Reduced, CountDifference
panel_20 = Panel(reduce_mesh_19.CountDifference)
python_3_script_76 = Python3Script(M=reduce_mesh_19.Reduced, B=rh_in_21_0_mapeado)  # -> a; inputs M: Mesh, B: list of Int32; same code as python_3_script_11
python_3_script_77 = Python3Script(M=mesh_join_56, B=rh_in_21_0_mapeado)  # -> a; inputs M: Mesh, B: list of Int32; same code as python_3_script_11
rh_out_mdp_reenguece_der = Geometry(python_3_script_76)
rh_out_reenguece_der_b = Geometry(python_3_script_77)

# ----
# Box Mapping 3.8
python_3_script_78 = Python3Script(M=mesh_join_55, B=rh_in_21_0_mapeado)  # -> a; inputs M: Mesh, B: list of Int32; same code as python_3_script_11

# ---- group: Reenguece Der (continued)
rh_out_reenguece_der = Geometry(python_3_script_78)

# ---- group: Refuerzo Posterior Der (continued)
diagnostico_20 = Panel(python_3_script_72.Out)
mesh_brep_58 = MeshBrep(
    Brep=python_3_script_72.NURBS_Color,
    Settings={GridMaxCount=0, GridMinCount=16, JaggedSeams=False, MaxEdgeLength=0, MinEdgeLength=0.0001, MinTolerance=0, Refine=True, RefineAngle=0, RelativeTolerance=0.65, SimplePlanes=True, Tolerance=0})
mesh_brep_59 = MeshBrep(
    Brep=python_3_script_72.NURBS_Balance,
    Settings={GridMaxCount=0, GridMinCount=16, JaggedSeams=False, MaxEdgeLength=0, MinEdgeLength=0.0001, MinTolerance=0, Refine=True, RefineAngle=0, RelativeTolerance=0.65, SimplePlanes=True, Tolerance=0})
mesh_brep_60 = MeshBrep(
    Brep=python_3_script_72.NURBS_MDP,
    Settings={GridMaxCount=0, GridMinCount=16, JaggedSeams=False, MaxEdgeLength=0, MinEdgeLength=0.0001, MinTolerance=0, Refine=True, RefineAngle=0, RelativeTolerance=0.65, SimplePlanes=True, Tolerance=0})
mesh_join_58 = MeshJoin(Meshes=flatten(mesh_brep_58))
mesh_join_59 = MeshJoin(Meshes=flatten(mesh_brep_59))
mesh_join_60 = MeshJoin(Meshes=flatten(mesh_brep_60))
reduce_mesh_20 = ReduceMesh(Mesh=mesh_join_60, FaceCount=20, Accuracy=1, FaceType=segmentacion_20, Distort=Toggle(False), Normalize=Toggle(True))  # -> Reduced, CountDifference
panel_21 = Panel(reduce_mesh_20.CountDifference)
python_3_script_79 = Python3Script(M=reduce_mesh_20.Reduced, B=rh_in_18_0_mapeado)  # -> a; inputs M: Mesh, B: list of Int32; same code as python_3_script_11
python_3_script_80 = Python3Script(M=mesh_join_59, B=rh_in_18_0_mapeado)  # -> a; inputs M: Mesh, B: list of Int32; same code as python_3_script_11
rh_out_mdp_refuerzo_posterior_der = Geometry(python_3_script_79)
rh_out_refuerzo_posterior_der_b = Geometry(python_3_script_80)

# ----
# Box Mapping 3.8
python_3_script_81 = Python3Script(M=mesh_join_58, B=rh_in_18_0_mapeado)  # -> a; inputs M: Mesh, B: list of Int32; same code as python_3_script_11

# ---- group: Refuerzo Posterior Der (continued)
rh_out_refuerzo_posterior_der = Geometry(python_3_script_81)
