# Grasshopper definition Cubierta.ghx (Grasshopper 1.0.8)
# plug-ins: Pufferfish

# ---- group: Dimensiones Principales
rh_in_01_2_profundidad = Slider(480, range=200..600)
rh_in_01_1_ancho = Slider(498, range=300..2440)
domain_box = DomainBox(Base=PlaneXY(0, 0, 0), X=rh_in_01_1_ancho, Y=rh_in_01_2_profundidad, Z="15")

# ---- group: Recedidos
deconstruct_brep = DeconstructBrep(Brep=domain_box)  # -> Faces, Edges, Vertices
list_item = ListItem(List=deconstruct_brep.Vertices, Index="0", Wrap=True)
list_item_2 = ListItem(List=deconstruct_brep.Vertices, Index="6", Wrap=True)
rh_in_derecho = Slider(0, range=0..200)
rh_in_izquierdo = Slider(0, range=0..200)
unit_x = UnitX(Factor=rh_in_derecho)
unit_x_2 = UnitX(Factor=rh_in_izquierdo)
negative = Negative(Value=unit_x_2)
move = Move(Geometry=list_item_2, Motion=unit_x)  # -> Geometry, Transform
move_2 = Move(Geometry=list_item, Motion=negative)  # -> Geometry, Transform
box_2pt = Box2Pt(PointA=move_2.Geometry, PointB=move.Geometry, Plane=PlaneXY(0, 0, 0))

# ----
deconstruct_brep_2 = DeconstructBrep(Brep=box_2pt)  # -> Faces, Edges, Vertices
list_item_3 = ListItem(List=deconstruct_brep_2.Faces, Index="0", Wrap=True)
list_item_4 = ListItem(List=deconstruct_brep_2.Edges, Index="11", Wrap=True)
list_item_5 = ListItem(List=deconstruct_brep_2.Faces, Index="3", Wrap=True)
area = Area(Geometry=list_item_5)  # -> Area, Centroid
curve_middle = CurveMiddle(Curve=list_item_4)
area_2 = Area(Geometry=list_item_3)  # -> Area, Centroid
line = Line(StartPoint=area.Centroid, EndPoint=curve_middle)
yz_plane = YZPlane(Origin=area_2.Centroid)
xz_plane = XZPlane(Origin=area.Centroid)
length = Length(Curve=line)
panel = Panel(length)
distancia_minima_al_borde = Panel("20")
paso_maquinas = Panel("32")
subtraction = Subtraction(A=panel, B=distancia_minima_al_borde)
division = Division(A=subtraction, B=paso_maquinas)
panel_2 = Panel(division)
round = Round(Number=panel_2)  # -> Nearest, Floor, Ceiling
panel_3 = Panel(round.Floor)
multiplication = Multiplication(A=panel_3, B=paso_maquinas)
unit_y = UnitY(Factor=multiplication)
negative_2 = Negative(Value=paso_maquinas)
move_3 = Move(Geometry=area.Centroid, Motion=unit_y)  # -> Geometry, Transform
unit_y_2 = UnitY(Factor=negative_2)

# ---- group: Herrajes y Posiciones
mesh = Mesh(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)
point = Point(Point(-129.5614886, 769.3949471, 2344.988425))

mesh_2 = Mesh(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)
point_2 = Point(Point(-130.5614886, 641.3949471, 2387.474102))

point_3 = Point(Point(-350.0506006, 865.8628817, 2416.437066))
mesh_3 = Mesh(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)
mesh_4 = Mesh(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)

mesh_5 = Mesh(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)
point_4 = Point(Point(-242.5764557, 1010.191843, 2686.05881))

# Maquinado Tarugos + Tornillo Drywall *Izquierdo
# Tarugo
# Tornillo drywall
# Maquinado Minifix *Izquierdo
# Minifix
# Soportes entrepaño
# Soporte entrepaño
rh_in_02_5posicion_tornillo = ValueList({"-1": -32, "0", "1": 32, "2": 64}, selected="1")
rh_in_02_4_posicion_tarugo = ValueList({"-1": -32, "0", "1": 32, "2": 64}, selected="0")
rh_in_02_2_orientacion_minifix = ValueList({"abajo": 1, "arriba": 0}, selected="abajo")
rh_in_02_3posicion_minifix = ValueList({"-1": -32, "0", "1": 32, "2": 64}, selected="1")
yz_plane_2 = YZPlane(Origin=move_3.Geometry)
unit_y_3 = UnitY(Factor=rh_in_02_4_posicion_tarugo)
deconstruct_brep_3 = DeconstructBrep(Brep=domain_box)  # -> Faces, Edges, Vertices
cylinder = Cylinder(Base=yz_plane_2, Radius="3", Length="-15")
unit_x_3 = UnitX(Factor="22")
unit_y_4 = UnitY(Factor=rh_in_02_5posicion_tornillo)
move_to_point = MoveToPoint(Geometry=mesh_2, PointA=point_2, PointB=move_3.Geometry)  # -> Moved, Vector, Transform
negative_3 = Negative(Value=unit_y_3)
list_item_6 = ListItem(List=deconstruct_brep_3.Vertices, Index="0", Wrap=True)
list_item_7 = ListItem(List=deconstruct_brep_3.Vertices, Index="6", Wrap=True)
list_item_8 = ListItem(List=deconstruct_brep_3.Faces, Index="0", Wrap=True)
move_4 = Move(Geometry=move_3.Geometry, Motion=unit_x_3)  # -> Geometry, Transform
negative_4 = Negative(Value=unit_y_4)
move_5 = Move(Geometry=move_3.Geometry, Motion=negative_3)  # -> Geometry, Transform
area_3 = Area(Geometry=list_item_8)  # -> Area, Centroid
unit_x_4 = UnitX(Factor="0.5")
unit_x_5 = UnitX(Factor="-0.5")
move_6 = Move(Geometry=move_to_point.Moved, Motion=negative_4)  # -> Geometry, Transform
move_7 = Move(Geometry=list_item_6, Motion=unit_x_4)  # -> Geometry, Transform
move_8 = Move(Geometry=list_item_7, Motion=unit_x_5)  # -> Geometry, Transform
move_to_point_2 = MoveToPoint(Geometry=mesh, PointA=point, PointB=move_5.Geometry)  # -> Moved, Vector, Transform
yz_plane_3 = YZPlane(Origin=area_3.Centroid)
unit_y_5 = UnitY(Factor=rh_in_02_5posicion_tornillo)
unit_y_6 = UnitY(Factor=rh_in_02_4_posicion_tarugo)
unit_y_7 = UnitY(Factor=rh_in_02_5posicion_tornillo)
negative_5 = Negative(Value=unit_y_5)
mirror = Mirror(Geometry=move_to_point_2.Moved, Plane=xz_plane)  # -> Geometry, Transform
unit_z = UnitZ(Factor="-4.5")
cylinder_2 = Cylinder(Base=yz_plane_2, Radius="1.5", Length="20")
box_2pt_2 = Box2Pt(PointA=move_7.Geometry, PointB=move_8.Geometry, Plane=PlaneXY(0, 0, 0))
negative_6 = Negative(Value=unit_y_6)
negative_7 = Negative(Value=unit_y_7)
mirror_2 = Mirror(Geometry=move_6.Geometry, Plane=xz_plane)  # -> Geometry, Transform
unit_z_2 = UnitZ(Factor="-7.5")
move_9 = Move(Geometry=cylinder, Motion=negative_5)  # -> Geometry, Transform
move_10 = Move(Geometry=move_4.Geometry, Motion=negative_6)  # -> Geometry, Transform
move_11 = Move(Geometry=move_3.Geometry, Motion=unit_z_2)  # -> Geometry, Transform
move_12 = Move(Geometry=cylinder_2, Motion=negative_7)  # -> Geometry, Transform
cap_holes = CapHoles(Brep=move_9.Geometry)
yz_plane_4 = YZPlane(Origin=move_10.Geometry)
cap_holes_2 = CapHoles(Brep=move_12.Geometry)
cylinder_3 = Cylinder(Base=yz_plane_4, Radius="4", Length="-32")
cap_holes_3 = CapHoles(Brep=cylinder_3)
solid_union = SolidUnion(Breps=[cap_holes, cap_holes_2])
move_to_point_3 = MoveToPoint(Geometry=mesh_5, PointA=point_4, PointB=move_11.Geometry)  # -> Moved, Vector, Transform
solid_union_2 = SolidUnion(Breps=[solid_union, cap_holes_3])
mirror_3 = Mirror(Geometry=move_to_point_3.Moved, Plane=xz_plane)  # -> Geometry, Transform
mirror_4 = Mirror(Geometry=solid_union_2, Plane=xz_plane)  # -> Geometry, Transform
mirror_5 = Mirror(Geometry=[mirror_3.Geometry, move_to_point_3.Moved], Plane=yz_plane_3)  # -> Geometry, Transform
solid_union_3 = SolidUnion(Breps=[mirror_4.Geometry, solid_union_2])  # -> flatten(Result)
rh_in_02_1_union_izquierda = ValueList({"Ya definida": 0, "Tornillo tarugo": 1, "Minifix": 2, "Entrepaño": 3}, selected="Minifix")
rh_in_02_0_union_derecha = ValueList({"Ya definida": 0, "Tornillo tarugo": 1, "Minifix": 2}, selected="Minifix")
mirror_6 = Mirror(Geometry=solid_union_3, Plane=yz_plane)  # -> Geometry, Transform
mirror_7 = Mirror(Geometry=[mirror_2.Geometry, move_6.Geometry], Plane=yz_plane)  # -> Geometry, Transform
mirror_8 = Mirror(Geometry=[move_to_point_2.Moved, mirror.Geometry], Plane=yz_plane)  # -> Geometry, Transform
stream_filter = StreamFilter(Pieza=rh_in_02_1_union_izquierda, Stream0=box_2pt, Stream1=box_2pt, Stream2=box_2pt)
stream_filter_2 = StreamFilter(Entrepaño=rh_in_02_1_union_izquierda, Stream3=box_2pt_2)
stream_filter_3 = StreamFilter(Tornillos=rh_in_02_1_union_izquierda, Stream1=[mirror_2.Geometry, move_6.Geometry])
stream_filter_4 = StreamFilter(Tarugos=rh_in_02_1_union_izquierda, Stream1=[mirror.Geometry, move_to_point_2.Moved])
stream_filter_5 = StreamFilter(SoportesEntrepaño=rh_in_02_1_union_izquierda, Stream3=[move_to_point_3.Moved, mirror_3.Geometry, mirror_5.Geometry])
stream_filter_6 = StreamFilter(Tornillos=rh_in_02_0_union_derecha, Stream1=mirror_7.Geometry)
stream_filter_7 = StreamFilter(Tarugos=rh_in_02_0_union_derecha, Stream1=mirror_8.Geometry)
rh_out_soporte = Geometry(stream_filter_5)
rh_out_tornillo = Geometry([stream_filter_3, stream_filter_6])
rh_out_tarugo = Geometry([stream_filter_4, stream_filter_7])

# ----
unit_y_8 = UnitY(Factor=rh_in_02_3posicion_minifix)
negative_8 = Negative(Value=unit_y_8)
move_13 = Move(Geometry=move_3.Geometry, Motion=negative_8)  # -> Geometry, Transform
rh_out_mdpnurbs_entrepaño = Geometry(stream_filter_2)

# ---- group: Herrajes y Posiciones (continued)
yz_plane_5 = YZPlane(Origin=move_13.Geometry)
cylinder_4 = Cylinder(Base=yz_plane_5, Radius="3.5", Length="22")
cylinder_5 = Cylinder(Base=yz_plane_5, Radius="4", Length="-10")
yz_plane_6 = YZPlane(Origin=move_13.Geometry)
move_to_point_4 = MoveToPoint(Geometry=mesh_3, PointA=point_3, PointB=move_13.Geometry)  # -> Moved, Vector, Transform
cap_holes_4 = CapHoles(Brep=cylinder_4)
cap_holes_5 = CapHoles(Brep=cylinder_5)
deconstruct_brep_4 = DeconstructBrep(Brep=cap_holes_4)  # -> Faces, Edges, Vertices
rotate = Rotate(Geometry=move_to_point_4.Moved, Angle=degrees("180"), Plane=yz_plane_6)  # -> Geometry, Transform
mirror_9 = Mirror(Geometry=cap_holes_5, Plane=xz_plane)  # -> Geometry, Transform
move_to_point_5 = MoveToPoint(Geometry=mesh_4, PointA=point_3, PointB=move_13.Geometry)  # -> Moved, Vector, Transform
list_item_9 = ListItem(List=deconstruct_brep_4.Faces, Index="2", Wrap=True)
area_4 = Area(Geometry=list_item_9)  # -> Area, Centroid
mirror_10 = Mirror(Geometry=[cap_holes_5, mirror_9.Geometry], Plane=yz_plane)  # -> Geometry, Transform
mirror_11 = Mirror(Geometry=move_to_point_5.Moved, Plane=xz_plane)  # -> Geometry, Transform
move_14 = Move(Geometry=area_4.Centroid, Motion=unit_z)  # -> Geometry, Transform
xy_plane = XYPlane(Origin=move_14.Geometry)
mirror_12 = Mirror(Geometry=[move_to_point_5.Moved, mirror_11.Geometry], Plane=yz_plane)  # -> Geometry, Transform
cylinder_6 = Cylinder(Base=xy_plane, Radius="7.5", Length="12")
yz_plane_7 = YZPlane(Origin=move_13.Geometry)
cap_holes_6 = CapHoles(Brep=cylinder_6)
solid_union_4 = SolidUnion(Breps=[cap_holes_6, cap_holes_4])
rotate_2 = Rotate(Geometry=solid_union_4, Angle=degrees("180"), Plane=yz_plane_7)  # -> Geometry, Transform
stream_filter_8 = StreamFilter(Gate=rh_in_02_2_orientacion_minifix, Stream0=solid_union_4, Stream1=rotate_2.Geometry)
mirror_13 = Mirror(Geometry=stream_filter_8, Plane=xz_plane)  # -> Geometry, Transform
solid_union_5 = SolidUnion(Breps=[stream_filter_8, mirror_13.Geometry])  # -> flatten(Result)
mirror_14 = Mirror(Geometry=solid_union_5, Plane=yz_plane)  # -> Geometry, Transform
stream_filter_9 = StreamFilter(Maquinados=rh_in_02_1_union_izquierda, Stream1=solid_union_3, Stream2=solid_union_5)
stream_filter_10 = StreamFilter(Perno_0007374=rh_in_02_1_union_izquierda, Stream2=[move_to_point_5.Moved, mirror_11.Geometry])
stream_filter_11 = StreamFilter(MaquinadoMinifxGuia=rh_in_02_1_union_izquierda, Stream2=[cap_holes_5, mirror_9.Geometry])
stream_filter_12 = StreamFilter(Maquinados=rh_in_02_0_union_derecha, Stream1=mirror_6.Geometry, Stream2=mirror_14.Geometry)
stream_filter_13 = StreamFilter(MaquinadoMinifxGuia=rh_in_02_0_union_derecha, Stream2=mirror_10.Geometry)
stream_filter_14 = StreamFilter(Perno=rh_in_02_0_union_derecha, Stream2=mirror_12.Geometry)
rh_out_perno = Geometry([stream_filter_10, stream_filter_14])
mesh_brep = MeshBrep(
    Guias=[stream_filter_11, stream_filter_13, stream_filter_12, stream_filter_9],
    Settings={GridMaxCount=0, GridMinCount=16, JaggedSeams=False, MaxEdgeLength=0, MinEdgeLength=0.0001, MinTolerance=0, Refine=True, RefineAngle=0, RelativeTolerance=0.65, SimplePlanes=True, Tolerance=0})
rh_out_maquinados = Geometry(mesh_brep)
solid_union_6 = SolidUnion(Breps=flatten([stream_filter_9, stream_filter_12]))

# ----
stream_filter_15 = StreamFilter(Gate=rh_in_02_2_orientacion_minifix, Stream0=move_to_point_4.Moved, Stream1=rotate.Geometry)

# ---- group: Herrajes y Posiciones (continued)
mirror_15 = Mirror(Geometry=stream_filter_15, Plane=xz_plane)  # -> Geometry, Transform
mirror_16 = Mirror(Geometry=[mirror_15.Geometry, stream_filter_15], Plane=yz_plane)  # -> Geometry, Transform
stream_filter_16 = StreamFilter(Caja_0002715=rh_in_02_1_union_izquierda, Stream2=mirror_15.Geometry)
stream_filter_17 = StreamFilter(Gate=rh_in_02_0_union_derecha, Stream2=[mirror_16.Geometry, mirror_15.Geometry, stream_filter_15])
rh_out_caja = Geometry([stream_filter_17, stream_filter_16])

# ---- group: Acabados Cubierta
# Pieza tipo Cubierta
# Pieza tipo Cubierta
rh_in_03_0_tipo_de_mapeado = ValueList({"Cubierta": 4, "Cubierta Atravesada": 5}, selected="Cubierta")
rh_in_03_1_lado_balance = ValueList({"Cara A": 5, "Cara B": 4, "D/D": 6}, selected="Cara B")
solid_difference = SolidDifference(BrepsA=stream_filter, BrepsB=solid_union_6)
panel_4 = Panel("4")
panel_5 = Panel("5")
borde_izquierdo = ValueList({"Canto": 0, "MDP": 1}, selected="MDP")
borde_derecho = ValueList({"Canto": 0, "MDP": 1}, selected="MDP")
rh_in_03_3_borde_derecho = ValueList({"Canto": 0, "MDP": 1}, selected="MDP")
rh_in_03_4_borde_izquierdo = ValueList({"Canto": 0, "MDP": 1}, selected="MDP")

deconstruct_brep_5 = DeconstructBrep(Brep=solid_difference)  # -> Faces, Edges, Vertices
panel_6 = Panel("1")
panel_7 = Panel("3")
stream_filter_18 = StreamFilter(Color=rh_in_03_1_lado_balance, Stream4=["0", "5"], Stream5=["0", "4"], Stream6=["0", "4", "5"])
stream_filter_19 = StreamFilter(Balance=rh_in_03_1_lado_balance, Stream4="4", Stream5="5")
list_length = ListLength(List=deconstruct_brep_5.Faces)
cantidad_de_caras = Panel(list_length)
list_item_10 = ListItem(List=deconstruct_brep_5.Faces, Index=stream_filter_19, Wrap=True)
list_item_11 = ListItem(List=deconstruct_brep_5.Faces, Index="1", Wrap=True)
list_item_12 = ListItem(List=deconstruct_brep_5.Faces, Index="3", Wrap=True)
list_item_13 = ListItem(List=deconstruct_brep_5.Faces, Index=stream_filter_18, Wrap=True)
subtraction_2 = Subtraction(A=cantidad_de_caras, B="6")
series = Series(Start="6", Step="1", Count=subtraction_2)
list_item_14 = ListItem(List=deconstruct_brep_5.Faces, Index=[series, "2"], Wrap=True)
stream_gate = StreamGate(Stream=list_item_11, Gate=rh_in_03_3_borde_derecho)  # -> Target0, Target1
stream_gate_2 = StreamGate(Stream=list_item_12, Gate=rh_in_03_4_borde_izquierdo)  # -> Target0, Target1
solid_union_7 = SolidUnion(Breps=[list_item_14, stream_gate_2.Target1, stream_gate.Target1])
solid_union_8 = SolidUnion(Breps=[list_item_13, stream_gate_2.Target0, stream_gate.Target0])
mesh_brep_2 = MeshBrep(
    Brep=solid_union_7,
    Settings={GridMaxCount=0, GridMinCount=16, JaggedSeams=False, MaxEdgeLength=0, MinEdgeLength=0.0001, MinTolerance=0, Refine=True, RefineAngle=0, RelativeTolerance=0.65, SimplePlanes=True, Tolerance=0})
mesh_brep_3 = MeshBrep(
    Color=solid_union_8,
    Settings={GridMaxCount=0, GridMinCount=16, JaggedSeams=False, MaxEdgeLength=0, MinEdgeLength=0.0001, MinTolerance=0, Refine=True, RefineAngle=0, RelativeTolerance=0.65, SimplePlanes=True, Tolerance=0})
mesh_brep_4 = MeshBrep(
    Balance=list_item_10,
    Settings={GridMaxCount=0, GridMinCount=16, JaggedSeams=False, MaxEdgeLength=0, MinEdgeLength=0.0001, MinTolerance=0, Refine=True, RefineAngle=0, RelativeTolerance=0.65, SimplePlanes=True, Tolerance=0})
mesh_join = MeshJoin(Meshes=mesh_brep_3)
mesh_join_2 = MeshJoin(Meshes=flatten(mesh_brep_2))
mesh_join_3 = MeshJoin(Meshes=mesh_brep_4)

# Mapeado
panel_8 = Panel("600")
tamaño_de_textura = Number(panel_8)
domain_box_2 = DomainBox(Base=PlaneXY(0, 0, 0), X=tamaño_de_textura, Y=tamaño_de_textura, Z=tamaño_de_textura)
unit_y_9 = UnitY(Factor=1)
domain_box_3 = DomainBox(Base=PlaneXY(0, 0, 0), X=tamaño_de_textura, Y=tamaño_de_textura, Z=tamaño_de_textura)
unit_x_6 = UnitX(Factor=1)
domain_box_4 = DomainBox(Base=PlaneXY(0, 0, 0), X=tamaño_de_textura, Y=tamaño_de_textura, Z=tamaño_de_textura)
unit_x_7 = UnitX(Factor=1)
domain_box_5 = DomainBox(Base=PlaneXY(0, 0, 0), X=tamaño_de_textura, Y=tamaño_de_textura, Z=tamaño_de_textura)
unit_x_8 = UnitX(Factor=1)
domain_box_6 = DomainBox(Base=PlaneXY(0, 0, 0), X=tamaño_de_textura, Y=tamaño_de_textura, Z=tamaño_de_textura)
unit_x_9 = UnitX(Factor=1)
domain_box_7 = DomainBox(Base=PlaneXY(0, 0, 0), X=tamaño_de_textura, Y=tamaño_de_textura, Z=tamaño_de_textura)
unit_z_3 = UnitZ(Factor=1)
rotate_3d = Rotate3D(Geometry=domain_box_2, Angle=degrees("90"), Center=Point(0, 0, 0), Axis=unit_y_9)  # -> Geometry, Transform
rotate_3d_2 = Rotate3D(Geometry=domain_box_3, Angle=degrees("180"), Center=Point(0, 0, 0), Axis=unit_x_6)  # -> Geometry, Transform
rotate_3d_3 = Rotate3D(Geometry=domain_box_4, Angle=degrees("90"), Center=Point(0, 0, 0), Axis=unit_x_7)  # -> Geometry, Transform
rotate_3d_4 = Rotate3D(Geometry=domain_box_5, Angle=degrees("90"), Center=Point(0, 0, 0), Axis=unit_x_8)  # -> Geometry, Transform
rotate_3d_5 = Rotate3D(Geometry=domain_box_6, Angle=degrees("0"), Center=Point(0, 0, 0), Axis=unit_x_9)  # -> Geometry, Transform
rotate_3d_6 = Rotate3D(Geometry=domain_box_7, Angle=degrees("90"), Center=Point(0, 0, 0), Axis=unit_z_3)  # -> Geometry, Transform
unit_x_10 = UnitX(Factor=1)
unit_y_10 = UnitY(Factor=1)
unit_y_11 = UnitY(Factor=1)
unit_y_12 = UnitY(Factor=1)
unit_y_13 = UnitY(Factor=1)
unit_y_14 = UnitY(Factor=1)
rotate_3d_7 = Rotate3D(Geometry=rotate_3d.Geometry, Angle=degrees("90"), Center=Point(0, 0, 0), Axis=unit_x_10)  # -> ParalAtravesado, Transform
rotate_3d_8 = Rotate3D(Geometry=rotate_3d_2.Geometry, Angle=degrees("90"), Center=Point(0, 0, 0), Axis=unit_y_10)  # -> Geometry, Transform
rotate_3d_9 = Rotate3D(Geometry=rotate_3d_3.Geometry, Angle=degrees("0"), Center=Point(0, 0, 0), Axis=unit_y_11)  # -> Geometry, Transform
rotate_3d_10 = Rotate3D(Geometry=rotate_3d_4.Geometry, Angle=degrees("90"), Center=Point(0, 0, 0), Axis=unit_y_12)  # -> Geometry, Transform
rotate_3d_11 = Rotate3D(Geometry=rotate_3d_5.Geometry, Angle=degrees("0"), Center=Point(0, 0, 0), Axis=unit_y_13)  # -> Geometry, Transform
rotate_3d_12 = Rotate3D(Geometry=rotate_3d_6.Geometry, Angle=degrees("0"), Center=Point(0, 0, 0), Axis=unit_y_14)  # -> CubiertaAtravesada, Transform
stream_filter_20 = StreamFilter(
    Gate=rh_in_03_0_tipo_de_mapeado,
    Stream0=rotate_3d_7.ParalAtravesado,
    Stream1=rotate_3d_8.Geometry,
    Stream2=rotate_3d_9.Geometry,
    Stream3=rotate_3d_10.Geometry,
    Stream4=rotate_3d_11.Geometry,
    Stream5=rotate_3d_12.CubiertaAtravesada)

# Mapeado
panel_9 = Panel("600")
tamaño_de_textura_2 = Number(panel_9)
domain_box_8 = DomainBox(Base=PlaneXY(0, 0, 0), X=tamaño_de_textura_2, Y=tamaño_de_textura_2, Z=tamaño_de_textura_2)
unit_y_15 = UnitY(Factor=1)
domain_box_9 = DomainBox(Base=PlaneXY(0, 0, 0), X=tamaño_de_textura_2, Y=tamaño_de_textura_2, Z=tamaño_de_textura_2)
unit_x_11 = UnitX(Factor=1)
domain_box_10 = DomainBox(Base=PlaneXY(0, 0, 0), X=tamaño_de_textura_2, Y=tamaño_de_textura_2, Z=tamaño_de_textura_2)
unit_x_12 = UnitX(Factor=1)
domain_box_11 = DomainBox(Base=PlaneXY(0, 0, 0), X=tamaño_de_textura_2, Y=tamaño_de_textura_2, Z=tamaño_de_textura_2)
unit_x_13 = UnitX(Factor=1)
domain_box_12 = DomainBox(Base=PlaneXY(0, 0, 0), X=tamaño_de_textura_2, Y=tamaño_de_textura_2, Z=tamaño_de_textura_2)
unit_x_14 = UnitX(Factor=1)
domain_box_13 = DomainBox(Base=PlaneXY(0, 0, 0), X=tamaño_de_textura_2, Y=tamaño_de_textura_2, Z=tamaño_de_textura_2)
unit_z_4 = UnitZ(Factor=1)
rotate_3d_13 = Rotate3D(Geometry=domain_box_8, Angle=degrees("90"), Center=Point(0, 0, 0), Axis=unit_y_15)  # -> Geometry, Transform
rotate_3d_14 = Rotate3D(Geometry=domain_box_9, Angle=degrees("180"), Center=Point(0, 0, 0), Axis=unit_x_11)  # -> Geometry, Transform
rotate_3d_15 = Rotate3D(Geometry=domain_box_10, Angle=degrees("90"), Center=Point(0, 0, 0), Axis=unit_x_12)  # -> Geometry, Transform
rotate_3d_16 = Rotate3D(Geometry=domain_box_11, Angle=degrees("90"), Center=Point(0, 0, 0), Axis=unit_x_13)  # -> Geometry, Transform
rotate_3d_17 = Rotate3D(Geometry=domain_box_12, Angle=degrees("0"), Center=Point(0, 0, 0), Axis=unit_x_14)  # -> Geometry, Transform
rotate_3d_18 = Rotate3D(Geometry=domain_box_13, Angle=degrees("90"), Center=Point(0, 0, 0), Axis=unit_z_4)  # -> Geometry, Transform
unit_x_15 = UnitX(Factor=1)
unit_y_16 = UnitY(Factor=1)
unit_y_17 = UnitY(Factor=1)
unit_y_18 = UnitY(Factor=1)
unit_y_19 = UnitY(Factor=1)
unit_y_20 = UnitY(Factor=1)
rotate_3d_19 = Rotate3D(Geometry=rotate_3d_13.Geometry, Angle=degrees("90"), Center=Point(0, 0, 0), Axis=unit_x_15)  # -> ParalAtravesado, Transform
rotate_3d_20 = Rotate3D(Geometry=rotate_3d_14.Geometry, Angle=degrees("90"), Center=Point(0, 0, 0), Axis=unit_y_16)  # -> Geometry, Transform
rotate_3d_21 = Rotate3D(Geometry=rotate_3d_15.Geometry, Angle=degrees("0"), Center=Point(0, 0, 0), Axis=unit_y_17)  # -> Geometry, Transform
rotate_3d_22 = Rotate3D(Geometry=rotate_3d_16.Geometry, Angle=degrees("90"), Center=Point(0, 0, 0), Axis=unit_y_18)  # -> Geometry, Transform
rotate_3d_23 = Rotate3D(Geometry=rotate_3d_17.Geometry, Angle=degrees("0"), Center=Point(0, 0, 0), Axis=unit_y_19)  # -> Geometry, Transform
rotate_3d_24 = Rotate3D(Geometry=rotate_3d_18.Geometry, Angle=degrees("0"), Center=Point(0, 0, 0), Axis=unit_y_20)  # -> CubiertaAtravesada, Transform
stream_filter_21 = StreamFilter(
    Gate=rh_in_03_0_tipo_de_mapeado,
    Stream0=rotate_3d_19.ParalAtravesado,
    Stream1=rotate_3d_20.Geometry,
    Stream2=rotate_3d_21.Geometry,
    Stream3=rotate_3d_22.Geometry,
    Stream4=rotate_3d_23.Geometry,
    Stream5=rotate_3d_24.CubiertaAtravesada)

deconstruct_brep_6 = DeconstructBrep(Brep=stream_filter_2)  # -> Faces, Edges, Vertices
stream_filter_22 = StreamFilter(Balance=rh_in_03_1_lado_balance, Stream4="4", Stream5="5")
stream_filter_23 = StreamFilter(Color=rh_in_03_1_lado_balance, Stream4=["0", panel_5], Stream5=["0", panel_4], Stream6=["0", panel_4, panel_5])
list_length_2 = ListLength(List=deconstruct_brep_6.Faces)
cantidad_de_caras_2 = Panel(list_length_2)
list_item_15 = ListItem(List=deconstruct_brep_6.Faces, Index=stream_filter_22, Wrap=True)
list_item_16 = ListItem(List=deconstruct_brep_6.Faces, Index=stream_filter_23, Wrap=True)
subtraction_3 = Subtraction(A=cantidad_de_caras_2, B="6")
series_2 = Series(Start="6", Step="1", Count=subtraction_3)
list_item_17 = ListItem(List=deconstruct_brep_6.Faces, Index=[series_2, "2"], Wrap=True)
mesh_brep_5 = MeshBrep(
    Balance=list_item_15,
    Settings={GridMaxCount=0, GridMinCount=16, JaggedSeams=False, MaxEdgeLength=0, MinEdgeLength=0.0001, MinTolerance=0, Refine=True, RefineAngle=0, RelativeTolerance=0.65, SimplePlanes=True, Tolerance=0})
mesh_join_4 = MeshJoin(Meshes=mesh_brep_5)

list_item_18 = ListItem(List=deconstruct_brep_6.Faces, Index="1", Wrap=True)
list_item_19 = ListItem(List=deconstruct_brep_6.Faces, Index="3", Wrap=True)
stream_gate_3 = StreamGate(Stream=list_item_18, Gate=borde_derecho)  # -> Target0, Target1
stream_gate_4 = StreamGate(Stream=list_item_19, Gate=borde_izquierdo)  # -> Target0, Target1
solid_union_9 = SolidUnion(Breps=[list_item_17, stream_gate_4.Target1, stream_gate_3.Target1])
solid_union_10 = SolidUnion(Breps=[list_item_16, stream_gate_4.Target0, stream_gate_3.Target0])
rh_out_balance_entrepaño = Geometry(mesh_join_4)
rh_out_color_cubierta = Geometry(mesh_join)
rh_out_balance_cubierta = Geometry(mesh_join_3)
rh_out_mdp = Geometry(mesh_join_2)

mesh_brep_6 = MeshBrep(
    Brep=solid_union_9,
    Settings={GridMaxCount=0, GridMinCount=16, JaggedSeams=False, MaxEdgeLength=0, MinEdgeLength=0.0001, MinTolerance=0, Refine=True, RefineAngle=0, RelativeTolerance=0.65, SimplePlanes=True, Tolerance=0})
mesh_brep_7 = MeshBrep(
    Color=solid_union_10,
    Settings={GridMaxCount=0, GridMinCount=16, JaggedSeams=False, MaxEdgeLength=0, MinEdgeLength=0.0001, MinTolerance=0, Refine=True, RefineAngle=0, RelativeTolerance=0.65, SimplePlanes=True, Tolerance=0})
mesh_join_5 = MeshJoin(Meshes=flatten(mesh_brep_6))
mesh_join_6 = MeshJoin(Meshes=mesh_brep_7)

rh_out_color_entrepaño = Geometry(mesh_join_6)
rh_out_mdp_2 = Geometry(mesh_join_5)
