# Grasshopper definition Cubierta.ghx (Grasshopper 1.0.8)

# ---- group: Dimensiones Principales
rh_in_01_1_ancho = Slider(498, range=300..2440)
rh_in_01_2_profundidad = Slider(480, range=200..600)
domain_box = DomainBox(Base=PlaneXY(0, 0, 0), X=rh_in_01_1_ancho, Y=rh_in_01_2_profundidad, Z="15")

# ---- group: Recedidos
deconstruct_brep = DeconstructBrep(Brep=domain_box)  # -> Faces, Edges, Vertices
list_item = ListItem(List=deconstruct_brep.Vertices, Index="0", Wrap=True)
list_item_2 = ListItem(List=deconstruct_brep.Vertices, Index="6", Wrap=True)
rh_in_derecho = Slider(0, range=0..200)
rh_in_izquierdo = Slider(0, range=0..200)
unit_x = UnitX(Factor=rh_in_derecho)
unit_x_2 = UnitX(Factor=rh_in_izquierdo)
negative = Negative(Value=unit_x_2)
move = Move(Geometry=list_item_2, Motion=unit_x)  # -> Geometry, Transform
move_2 = Move(Geometry=list_item, Motion=negative)  # -> Geometry, Transform
box_2pt = Box2Pt(PointA=move_2.Geometry, PointB=move.Geometry, Plane=PlaneXY(0, 0, 0))

# ----
deconstruct_brep_2 = DeconstructBrep(Brep=box_2pt)  # -> Faces, Edges, Vertices
list_item_3 = ListItem(List=deconstruct_brep_2.Faces, Index="0", Wrap=True)
list_item_4 = ListItem(List=deconstruct_brep_2.Edges, Index="11", Wrap=True)
list_item_5 = ListItem(List=deconstruct_brep_2.Faces, Index="3", Wrap=True)
area = Area(Geometry=list_item_5)  # -> Area, Centroid
curve_middle = CurveMiddle(Curve=list_item_4)
area_2 = Area(Geometry=list_item_3)  # -> Area, Centroid
line = Line(StartPoint=area.Centroid, EndPoint=curve_middle)
yz_plane = YZPlane(Origin=area_2.Centroid)
xz_plane = XZPlane(Origin=area.Centroid)
length = Length(Curve=line)
panel = Panel(length)
distancia_minima_al_borde = Panel("20")
paso_maquinas = Panel("32")
subtraction = Subtraction(A=panel, B=distancia_minima_al_borde)
division = Division(A=subtraction, B=paso_maquinas)
panel_2 = Panel(division)
round = Round(Number=panel_2)  # -> Nearest, Floor, Ceiling
panel_3 = Panel(round.Floor)
multiplication = Multiplication(A=panel_3, B=paso_maquinas)
unit_y = UnitY(Factor=multiplication)
negative_2 = Negative(Value=paso_maquinas)
move_3 = Move(Geometry=area.Centroid, Motion=unit_y)  # -> Geometry, Transform
unit_y_2 = UnitY(Factor=negative_2)

yz_plane_2 = YZPlane(Origin=move_3.Geometry)
cylinder = Cylinder(Base=yz_plane_2, Radius="4", Length="-10")
cap_holes = CapHoles(Brep=cylinder)
mirror = Mirror(Geometry=cap_holes, Plane=xz_plane)  # -> Geometry, Transform

# ---- group: Herrajes y Posiciones
point = Point(Point(-100, 0, 0))
mesh = Mesh(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)

mesh_2 = Mesh(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)
point_2 = Point(Point(-200, 0, 0))

point_3 = Point(Point(-300, 0, 0))
mesh_3 = Mesh(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)
mesh_4 = Mesh(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)
mesh_5 = Mesh(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)

# ----
vector_2pt = Vector2Pt(PointA=point_2, PointB=move_3.Geometry, Unitize=False)  # -> Vector, Length
move_4 = Move(Geometry=mesh_2, Motion=vector_2pt.Vector)  # -> Geometry, Transform

# ---- group: Herrajes y Posiciones
mesh_6 = Mesh(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)
point_4 = Point(Point(-400, 0, 0))

# ---- group: Acabados Cubierta / Probador de Mapeo
cubierta = Brep(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)
paral = Brep(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)
frontal = Brep(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)
mesh_brep = MeshBrep(
    Color=cubierta,
    Settings={GridMaxCount=0, GridMinCount=16, JaggedSeams=False, MaxEdgeLength=0, MinEdgeLength=0.0001, MinTolerance=0, Refine=True, RefineAngle=0, RelativeTolerance=0.65, SimplePlanes=True, Tolerance=0})
mesh_join = MeshJoin(Meshes=mesh_brep)

# ---- group: Herrajes y Posiciones
# Maquinado Tarugos + Tornillo Drywall *Izquierdo
# Tarugo
# Tornillo drywall
# Maquinado Minifix *Izquierdo
# Minifix
# Soportes entrepaño
# Soporte entrepaño
rh_in_02_5posicion_tornillo = ValueList({"-1": -32, "0", "1": 32, "2": 64}, selected="1")
rh_in_02_4_posicion_tarugo = ValueList({"-1": -32, "0", "1": 32, "2": 64}, selected="0")
rh_in_02_2_orientacion_minifix = ValueList({"abajo": 1, "arriba": 0}, selected="abajo")
rh_in_02_3posicion_minifix = ValueList({"-1": -32, "0", "1": 32, "2": 64}, selected="1")
unit_y_3 = UnitY(Factor=rh_in_02_3posicion_minifix)
yz_plane_3 = YZPlane(Origin=move_3.Geometry)
unit_y_4 = UnitY(Factor=rh_in_02_4_posicion_tarugo)
negative_3 = Negative(Value=unit_y_3)
deconstruct_brep_3 = DeconstructBrep(Brep=domain_box)  # -> Faces, Edges, Vertices
cylinder_2 = Cylinder(Base=yz_plane_3, Radius="3", Length="-15")
unit_x_3 = UnitX(Factor="22")
unit_y_5 = UnitY(Factor=rh_in_02_5posicion_tornillo)
negative_4 = Negative(Value=unit_y_4)
move_5 = Move(Geometry=move_3.Geometry, Motion=negative_3)  # -> Geometry, Transform
yz_plane_4 = YZPlane(Origin=move_5.Geometry)
cylinder_3 = Cylinder(Base=yz_plane_4, Radius="3.5", Length="24")
cylinder_4 = Cylinder(Base=yz_plane_4, Radius="4", Length="-10")
list_item_6 = ListItem(List=deconstruct_brep_3.Vertices, Index="0", Wrap=True)
list_item_7 = ListItem(List=deconstruct_brep_3.Vertices, Index="6", Wrap=True)
list_item_8 = ListItem(List=deconstruct_brep_3.Faces, Index="0", Wrap=True)
yz_plane_5 = YZPlane(Origin=move_5.Geometry)
move_6 = Move(Geometry=move_3.Geometry, Motion=unit_x_3)  # -> Geometry, Transform
cap_holes_2 = CapHoles(Brep=cylinder_3)
negative_5 = Negative(Value=unit_y_5)
cap_holes_3 = CapHoles(Brep=cylinder_4)
move_7 = Move(Geometry=move_3.Geometry, Motion=negative_4)  # -> Geometry, Transform
area_3 = Area(Geometry=list_item_8)  # -> Area, Centroid
unit_x_4 = UnitX(Factor="0.5")
unit_x_5 = UnitX(Factor="-0.5")
deconstruct_brep_4 = DeconstructBrep(Brep=cap_holes_2)  # -> Faces, Edges, Vertices
mirror_2 = Mirror(Geometry=cap_holes_3, Plane=xz_plane)  # -> Geometry, Transform
move_8 = Move(Geometry=move_4.Geometry, Motion=negative_5)  # -> Geometry, Transform
move_9 = Move(Geometry=list_item_6, Motion=unit_x_4)  # -> Geometry, Transform
move_10 = Move(Geometry=list_item_7, Motion=unit_x_5)  # -> Geometry, Transform
yz_plane_6 = YZPlane(Origin=area_3.Centroid)
unit_y_6 = UnitY(Factor=rh_in_02_5posicion_tornillo)
list_item_9 = ListItem(List=deconstruct_brep_4.Faces, Index="2", Wrap=True)
unit_y_7 = UnitY(Factor=rh_in_02_4_posicion_tarugo)
unit_y_8 = UnitY(Factor=rh_in_02_5posicion_tornillo)
area_4 = Area(Geometry=list_item_9)  # -> Area, Centroid
negative_6 = Negative(Value=unit_y_6)
unit_z = UnitZ(Factor="-4.5")
cylinder_5 = Cylinder(Base=yz_plane_3, Radius="1.5", Length="20")
mirror_3 = Mirror(Geometry=[cap_holes_3, mirror_2.Geometry], Plane=yz_plane)  # -> Geometry, Transform
box_2pt_2 = Box2Pt(PointA=move_9.Geometry, PointB=move_10.Geometry, Plane=PlaneXY(0, 0, 0))
negative_7 = Negative(Value=unit_y_7)
negative_8 = Negative(Value=unit_y_8)
mirror_4 = Mirror(Geometry=move_8.Geometry, Plane=xz_plane)  # -> Geometry, Transform
unit_z_2 = UnitZ(Factor="-7.5")
move_11 = Move(Geometry=cylinder_2, Motion=negative_6)  # -> Geometry, Transform
move_12 = Move(Geometry=area_4.Centroid, Motion=unit_z)  # -> Geometry, Transform
move_13 = Move(Geometry=move_6.Geometry, Motion=negative_7)  # -> Geometry, Transform
move_14 = Move(Geometry=move_3.Geometry, Motion=unit_z_2)  # -> Geometry, Transform
move_15 = Move(Geometry=cylinder_5, Motion=negative_8)  # -> Geometry, Transform
xy_plane = XYPlane(Origin=move_12.Geometry)
cap_holes_4 = CapHoles(Brep=move_11.Geometry)
yz_plane_7 = YZPlane(Origin=move_13.Geometry)
cap_holes_5 = CapHoles(Brep=move_15.Geometry)
cylinder_6 = Cylinder(Base=xy_plane, Radius="7.5", Length="12")
yz_plane_8 = YZPlane(Origin=move_5.Geometry)
cylinder_7 = Cylinder(Base=yz_plane_7, Radius="4", Length="-32")
cap_holes_6 = CapHoles(Brep=cylinder_6)
solid_union = SolidUnion(Breps=[cap_holes_6, cap_holes_2])
cap_holes_7 = CapHoles(Brep=cylinder_7)
rotate = Rotate(Geometry=solid_union, Angle=degrees("180"), Plane=yz_plane_8)  # -> Geometry, Transform
solid_union_2 = SolidUnion(Breps=[cap_holes_4, cap_holes_5])
stream_filter = StreamFilter(Gate=rh_in_02_2_orientacion_minifix, Stream0=solid_union, Stream1=rotate.Geometry)
solid_union_3 = SolidUnion(Breps=[solid_union_2, cap_holes_7])
mirror_5 = Mirror(Geometry=stream_filter, Plane=xz_plane)  # -> Geometry, Transform
mirror_6 = Mirror(Geometry=solid_union_3, Plane=xz_plane)  # -> Geometry, Transform
solid_union_4 = SolidUnion(Breps=[stream_filter, mirror_5.Geometry])  # -> flatten(Result)
solid_union_5 = SolidUnion(Breps=[mirror_6.Geometry, solid_union_3])  # -> flatten(Result)
mirror_7 = Mirror(Geometry=solid_union_4, Plane=yz_plane)  # -> Geometry, Transform
rh_in_02_1_union_izquierda = ValueList({"Ya definida": 0, "Tornillo tarugo": 1, "Minifix": 2, "Entrepaño": 3}, selected="Minifix")
rh_in_02_0_union_derecha = ValueList({"Ya definida": 0, "Tornillo tarugo": 1, "Minifix": 2}, selected="Minifix")
mirror_8 = Mirror(Geometry=solid_union_5, Plane=yz_plane)  # -> Geometry, Transform
mirror_9 = Mirror(Geometry=[mirror_4.Geometry, move_8.Geometry], Plane=yz_plane)  # -> Geometry, Transform
stream_filter_2 = StreamFilter(Pieza=rh_in_02_1_union_izquierda, Stream0=box_2pt, Stream1=box_2pt, Stream2=box_2pt)
stream_filter_3 = StreamFilter(Maquinados=rh_in_02_1_union_izquierda, Stream1=solid_union_5, Stream2=solid_union_4)
stream_filter_4 = StreamFilter(Tornillos=rh_in_02_1_union_izquierda, Stream1=[mirror_4.Geometry, move_8.Geometry])
stream_filter_5 = StreamFilter(MaquinadoMinifxGuia=rh_in_02_1_union_izquierda, Stream2=[cap_holes_3, mirror_2.Geometry])
stream_filter_6 = StreamFilter(Maquinados=rh_in_02_0_union_derecha, Stream1=mirror_8.Geometry, Stream2=mirror_7.Geometry)
stream_filter_7 = StreamFilter(MaquinadoMinifxGuia=rh_in_02_0_union_derecha, Stream2=mirror_3.Geometry)
stream_filter_8 = StreamFilter(Tornillos=rh_in_02_0_union_derecha, Stream1=mirror_9.Geometry)
stream_filter_9 = StreamFilter(Entrepaño=rh_in_02_1_union_izquierda, Stream3=box_2pt_2)
rh_out_tornillo = Geometry([stream_filter_4, stream_filter_8])
rh_out_nurbs_perforados = Geometry()
solid_union_6 = SolidUnion(Breps=flatten([stream_filter_3, stream_filter_6]))

# ----
vector_2pt_2 = Vector2Pt(PointA=point_3, PointB=move_5.Geometry, Unitize=False)  # -> Vector, Length
vector_2pt_3 = Vector2Pt(PointA=point_3, PointB=move_5.Geometry, Unitize=False)  # -> Vector, Length
move_16 = Move(Geometry=mesh_3, Motion=vector_2pt_2.Vector)  # -> Geometry, Transform
move_17 = Move(Geometry=mesh_3, Motion=vector_2pt_3.Vector)  # -> Geometry, Transform
vector_2pt_4 = Vector2Pt(PointA=point_3, PointB=move_5.Geometry, Unitize=False)  # -> Vector, Length
vector_2pt_5 = Vector2Pt(PointA=point, PointB=move_7.Geometry, Unitize=False)  # -> Vector, Length
move_18 = Move(Geometry=mesh, Motion=vector_2pt_5.Vector)  # -> Geometry, Transform
move_19 = Move(Geometry=[mesh_4, mesh_5], Motion=vector_2pt_4.Vector)  # -> Geometry, Transform
vector_2pt_6 = Vector2Pt(PointA=point_4, PointB=move_14.Geometry, Unitize=False)  # -> Vector, Length
move_20 = Move(Geometry=mesh_6, Motion=vector_2pt_6.Vector)  # -> Geometry, Transform

# ---- group: Acabados Cubierta / Nurbs Cubierta
solid_difference = SolidDifference(BrepsA=stream_filter_2, BrepsB=solid_union_6)

# ---- group: Herrajes y Posiciones (continued)
rotate_2 = Rotate(Geometry=move_16.Geometry, Angle=degrees("180"), Plane=yz_plane_5)  # -> Geometry, Transform
mirror_10 = Mirror(Geometry=move_18.Geometry, Plane=xz_plane)  # -> Geometry, Transform
mirror_11 = Mirror(Geometry=move_19.Geometry, Plane=xz_plane)  # -> Geometry, Transform
stream_filter_10 = StreamFilter(Gate=rh_in_02_2_orientacion_minifix, Stream0=move_16.Geometry, Stream1=rotate_2.Geometry)
mirror_12 = Mirror(Geometry=stream_filter_10, Plane=xz_plane)  # -> Geometry, Transform
mirror_13 = Mirror(Geometry=[move_19.Geometry, mirror_11.Geometry], Plane=yz_plane)  # -> Geometry, Transform
mirror_14 = Mirror(Geometry=[mirror_12.Geometry, stream_filter_10], Plane=yz_plane)  # -> Geometry, Transform
mirror_15 = Mirror(Geometry=move_20.Geometry, Plane=xz_plane)  # -> Geometry, Transform
mirror_16 = Mirror(Geometry=[mirror_15.Geometry, move_20.Geometry], Plane=yz_plane_6)  # -> Geometry, Transform
mirror_17 = Mirror(Geometry=[move_18.Geometry, mirror_10.Geometry], Plane=yz_plane)  # -> Geometry, Transform
stream_filter_11 = StreamFilter(Gate=rh_in_02_0_union_derecha, Stream2=mirror_14.Geometry)
stream_filter_12 = StreamFilter(Tarugos=rh_in_02_1_union_izquierda, Stream1=[mirror_10.Geometry, move_18.Geometry])
stream_filter_13 = StreamFilter(SoportesEntrepaño=rh_in_02_1_union_izquierda, Stream3=[move_20.Geometry, mirror_15.Geometry, mirror_16.Geometry])
stream_filter_14 = StreamFilter(Tarugos=rh_in_02_0_union_derecha, Stream1=mirror_17.Geometry)
stream_filter_15 = StreamFilter(Perno=rh_in_02_1_union_izquierda, Stream2=[move_19.Geometry, mirror_11.Geometry])
stream_filter_16 = StreamFilter(Perno=rh_in_02_0_union_derecha, Stream2=mirror_13.Geometry)
rh_out_tarugo = Geometry([stream_filter_12, stream_filter_14])
rh_out_perno = Geometry([stream_filter_15, stream_filter_16])
rh_out_soporte = Geometry(stream_filter_13)

# ----
stream_filter_17 = StreamFilter(Gate=rh_in_02_1_union_izquierda, Stream2=[mirror_12.Geometry, stream_filter_10])

# ---- group: Herrajes y Posiciones (continued)
rh_out_caja = Geometry([stream_filter_11, stream_filter_17])

# ---- group: Acabados Cubierta
# Pieza tipo Cubierta
nurbs_entrepaño = Geometry(stream_filter_9)
rh_in_03_1_lado_balance = ValueList({"Cara A": 5, "Cara B": 4, "D/D": 6}, selected="Cara B")
rh_in_03_3_borde_derecho = ValueList({"Canto": 0, "MDP": 1}, selected="MDP")
rh_in_03_4_borde_izquierdo = ValueList({"Canto": 0, "MDP": 1}, selected="MDP")
rh_in_03_0_mapeado = ValueList({"Vertical": 0, "Vertical Atravesada": 1, "Frontal": 2, "Frontal Atravesada": 3, "Horizontal": 4, "Horizontal Atravesada": 5}, selected="Horizontal Atravesada")
panel_4 = Panel("5")
panel_5 = Panel("4")

# Entrepaño
deconstruct_brep_5 = DeconstructBrep(Brep=stream_filter_9)  # -> Faces, Edges, Vertices
panel_6 = Panel("1")
panel_7 = Panel("3")
stream_filter_18 = StreamFilter(Balance=rh_in_03_1_lado_balance, Stream4="4", Stream5="5")
stream_filter_19 = StreamFilter(Color=rh_in_03_1_lado_balance, Stream4=["0", panel_4], Stream5=["0", panel_5], Stream6=["0", panel_5, panel_4])
list_length = ListLength(List=deconstruct_brep_5.Faces)
cantidad_de_caras = Panel(list_length)
list_item_10 = ListItem(List=deconstruct_brep_5.Faces, Index=stream_filter_18, Wrap=True)
list_item_11 = ListItem(List=deconstruct_brep_5.Faces, Index=stream_filter_19, Wrap=True)
subtraction_2 = Subtraction(A=cantidad_de_caras, B="6")
list_item_12 = ListItem(List=deconstruct_brep_5.Faces, Index="1", Wrap=True)
list_item_13 = ListItem(List=deconstruct_brep_5.Faces, Index="3", Wrap=True)
series = Series(Start="6", Step="1", Count=subtraction_2)
borde_izquierdo = ValueList({"Canto": 0, "MDP": 1}, selected="MDP")
borde_derecho = ValueList({"Canto": 0, "MDP": 1}, selected="MDP")
list_item_14 = ListItem(List=deconstruct_brep_5.Faces, Index=[series, "2"], Wrap=True)
stream_gate = StreamGate(Stream=list_item_12, Gate=borde_derecho)  # -> Target0, Target1
stream_gate_2 = StreamGate(Stream=list_item_13, Gate=borde_izquierdo)  # -> Target0, Target1
solid_union_7 = SolidUnion(Breps=[list_item_11, stream_gate_2.Target0, stream_gate.Target0])
mesh_brep_2 = MeshBrep(
    Brep=[list_item_14, stream_gate.Target1, stream_gate_2.Target1],
    Settings={GridMaxCount=0, GridMinCount=16, JaggedSeams=False, MaxEdgeLength=0, MinEdgeLength=0.0001, MinTolerance=0, Refine=True, RefineAngle=0, RelativeTolerance=0.65, SimplePlanes=True, Tolerance=0})
mesh_brep_3 = MeshBrep(
    Color=solid_union_7,
    Settings={GridMaxCount=0, GridMinCount=16, JaggedSeams=False, MaxEdgeLength=0, MinEdgeLength=0.0001, MinTolerance=0, Refine=True, RefineAngle=0, RelativeTolerance=0.65, SimplePlanes=True, Tolerance=0})
mesh_brep_4 = MeshBrep(
    Balance=list_item_10,
    Settings={GridMaxCount=0, GridMinCount=16, JaggedSeams=False, MaxEdgeLength=0, MinEdgeLength=0.0001, MinTolerance=0, Refine=True, RefineAngle=0, RelativeTolerance=0.65, SimplePlanes=True, Tolerance=0})
mesh_join_2 = MeshJoin(Meshes=flatten(mesh_brep_2))
mesh_join_3 = MeshJoin(Meshes=mesh_brep_3)
mesh_join_4 = MeshJoin(Meshes=mesh_brep_4)

deconstruct_brep_6 = DeconstructBrep(Brep=solid_difference)  # -> Faces, Edges, Vertices
stream_filter_20 = StreamFilter(Color=rh_in_03_1_lado_balance, Stream4=["0", "5"], Stream5=["0", "4"], Stream6=["0", "4", "5"])
stream_filter_21 = StreamFilter(Balance=rh_in_03_1_lado_balance, Stream4="4", Stream5="5")
list_length_2 = ListLength(List=deconstruct_brep_6.Faces)
cantidad_de_caras_2 = Panel(list_length_2)
list_item_15 = ListItem(List=deconstruct_brep_6.Faces, Index=stream_filter_21, Wrap=True)
list_item_16 = ListItem(List=deconstruct_brep_6.Faces, Index="1", Wrap=True)
list_item_17 = ListItem(List=deconstruct_brep_6.Faces, Index="3", Wrap=True)
list_item_18 = ListItem(List=deconstruct_brep_6.Faces, Index=stream_filter_20, Wrap=True)
subtraction_3 = Subtraction(A=cantidad_de_caras_2, B="6")
series_2 = Series(Start="6", Step="1", Count=subtraction_3)
list_item_19 = ListItem(List=deconstruct_brep_6.Faces, Index=[series_2, "2"], Wrap=True)
stream_gate_3 = StreamGate(Stream=list_item_16, Gate=rh_in_03_3_borde_derecho)  # -> Target0, Target1
stream_gate_4 = StreamGate(Stream=list_item_17, Gate=rh_in_03_4_borde_izquierdo)  # -> Target0, Target1
solid_union_8 = SolidUnion(Breps=[list_item_19, stream_gate_4.Target1, stream_gate_3.Target1])
solid_union_9 = SolidUnion(Breps=[list_item_18, stream_gate_4.Target0, stream_gate_3.Target0])
mesh_brep_5 = MeshBrep(
    Brep=solid_union_8,
    Settings={GridMaxCount=0, GridMinCount=16, JaggedSeams=False, MaxEdgeLength=0, MinEdgeLength=0.0001, MinTolerance=0, Refine=True, RefineAngle=0, RelativeTolerance=0.65, SimplePlanes=True, Tolerance=0})
mesh_brep_6 = MeshBrep(
    Color=solid_union_9,
    Settings={GridMaxCount=0, GridMinCount=16, JaggedSeams=False, MaxEdgeLength=0, MinEdgeLength=0.0001, MinTolerance=0, Refine=True, RefineAngle=0, RelativeTolerance=0.65, SimplePlanes=True, Tolerance=0})
mesh_brep_7 = MeshBrep(
    Balance=list_item_15,
    Settings={GridMaxCount=0, GridMinCount=16, JaggedSeams=False, MaxEdgeLength=0, MinEdgeLength=0.0001, MinTolerance=0, Refine=True, RefineAngle=0, RelativeTolerance=0.65, SimplePlanes=True, Tolerance=0})
mesh_join_5 = MeshJoin(Meshes=mesh_brep_6)
mesh_join_6 = MeshJoin(Meshes=flatten(mesh_brep_5))
mesh_join_7 = MeshJoin(Meshes=mesh_brep_7)

# Mapeado
# 0
# 1
# 2
# 3
# 4
# 5
panel_10 = Panel("600")
domain_box_2 = DomainBox(Base=PlaneXY(0, 0, 0), X=panel_10, Y=panel_10, Z=panel_10)
unit_y_9 = UnitY(Factor=1)
domain_box_3 = DomainBox(Base=PlaneXY(0, 0, 0), X=panel_10, Y=panel_10, Z=panel_10)
unit_x_6 = UnitX(Factor=1)
domain_box_4 = DomainBox(Base=PlaneXY(0, 0, 0), X=panel_10, Y=panel_10, Z=panel_10)
unit_x_7 = UnitX(Factor=1)
domain_box_5 = DomainBox(Base=PlaneXY(0, 0, 0), X=panel_10, Y=panel_10, Z=panel_10)
unit_x_8 = UnitX(Factor=1)
domain_box_6 = DomainBox(Base=PlaneXY(0, 0, 0), X=panel_10, Y=panel_10, Z=panel_10)
unit_x_9 = UnitX(Factor=1)
domain_box_7 = DomainBox(Base=PlaneXY(0, 0, 0), X=panel_10, Y=panel_10, Z=panel_10)
unit_z_3 = UnitZ(Factor=1)
rotate_3d = Rotate3D(Geometry=domain_box_2, Angle=degrees("90"), Center=Point(0, 0, 0), Axis=unit_y_9)  # -> Geometry, Transform
rotate_3d_2 = Rotate3D(Geometry=domain_box_3, Angle=degrees("180"), Center=Point(0, 0, 0), Axis=unit_x_6)  # -> Geometry, Transform
rotate_3d_3 = Rotate3D(Geometry=domain_box_4, Angle=degrees("90"), Center=Point(0, 0, 0), Axis=unit_x_7)  # -> Geometry, Transform
rotate_3d_4 = Rotate3D(Geometry=domain_box_5, Angle=degrees("90"), Center=Point(0, 0, 0), Axis=unit_x_8)  # -> Geometry, Transform
rotate_3d_5 = Rotate3D(Geometry=domain_box_6, Angle=degrees("0"), Center=Point(0, 0, 0), Axis=unit_x_9)  # -> Geometry, Transform
rotate_3d_6 = Rotate3D(Geometry=domain_box_7, Angle=degrees("90"), Center=Point(0, 0, 0), Axis=unit_z_3)  # -> Geometry, Transform
unit_x_10 = UnitX(Factor=1)
unit_y_10 = UnitY(Factor=1)
unit_y_11 = UnitY(Factor=1)
unit_y_12 = UnitY(Factor=1)
# 0
# 0
unit_y_13 = UnitY(Factor=1)
unit_y_14 = UnitY(Factor=1)
rotate_3d_7 = Rotate3D(Geometry=rotate_3d.Geometry, Angle=degrees("90"), Center=Point(0, 0, 0), Axis=unit_x_10)  # -> ParalAtravesado, Transform
rotate_3d_8 = Rotate3D(Geometry=rotate_3d_2.Geometry, Angle=degrees("90"), Center=Point(0, 0, 0), Axis=unit_y_10)  # -> Geometry, Transform
rotate_3d_9 = Rotate3D(Geometry=rotate_3d_3.Geometry, Angle=degrees("0"), Center=Point(0, 0, 0), Axis=unit_y_11)  # -> Geometry, Transform
rotate_3d_10 = Rotate3D(Geometry=rotate_3d_4.Geometry, Angle=degrees("90"), Center=Point(0, 0, 0), Axis=unit_y_12)  # -> Geometry, Transform
rotate_3d_11 = Rotate3D(Geometry=rotate_3d_5.Geometry, Angle=degrees("0"), Center=Point(0, 0, 0), Axis=unit_y_13)  # -> Geometry, Transform
rotate_3d_12 = Rotate3D(Geometry=rotate_3d_6.Geometry, Angle=degrees("0"), Center=Point(0, 0, 0), Axis=unit_y_14)  # -> CubiertaAtravesada, Transform
stream_filter_22 = StreamFilter(
    Gate=rh_in_03_0_mapeado,
    Stream0=rotate_3d_8.Geometry,
    Stream1=rotate_3d_7.ParalAtravesado,
    Stream2=rotate_3d_9.Geometry,
    Stream3=rotate_3d_10.Geometry,
    Stream4=rotate_3d_11.Geometry,
    Stream5=rotate_3d_12.CubiertaAtravesada)

# Mapeado
# 0
# 1
# 2
# 0
# 0
# 3
# 4
# 5
panel_11 = Panel("600")
domain_box_8 = DomainBox(Base=PlaneXY(0, 0, 0), X=panel_11, Y=panel_11, Z=panel_11)
unit_y_15 = UnitY(Factor=1)
domain_box_9 = DomainBox(Base=PlaneXY(0, 0, 0), X=panel_11, Y=panel_11, Z=panel_11)
unit_x_11 = UnitX(Factor=1)
domain_box_10 = DomainBox(Base=PlaneXY(0, 0, 0), X=panel_11, Y=panel_11, Z=panel_11)
unit_x_12 = UnitX(Factor=1)
domain_box_11 = DomainBox(Base=PlaneXY(0, 0, 0), X=panel_11, Y=panel_11, Z=panel_11)
unit_x_13 = UnitX(Factor=1)
domain_box_12 = DomainBox(Base=PlaneXY(0, 0, 0), X=panel_11, Y=panel_11, Z=panel_11)
unit_x_14 = UnitX(Factor=1)
domain_box_13 = DomainBox(Base=PlaneXY(0, 0, 0), X=panel_11, Y=panel_11, Z=panel_11)
unit_z_4 = UnitZ(Factor=1)
rotate_3d_13 = Rotate3D(Geometry=domain_box_8, Angle=degrees("90"), Center=Point(0, 0, 0), Axis=unit_y_15)  # -> Geometry, Transform
rotate_3d_14 = Rotate3D(Geometry=domain_box_9, Angle=degrees("180"), Center=Point(0, 0, 0), Axis=unit_x_11)  # -> Geometry, Transform
rotate_3d_15 = Rotate3D(Geometry=domain_box_10, Angle=degrees("90"), Center=Point(0, 0, 0), Axis=unit_x_12)  # -> Geometry, Transform
rotate_3d_16 = Rotate3D(Geometry=domain_box_11, Angle=degrees("90"), Center=Point(0, 0, 0), Axis=unit_x_13)  # -> Geometry, Transform
rotate_3d_17 = Rotate3D(Geometry=domain_box_12, Angle=degrees("0"), Center=Point(0, 0, 0), Axis=unit_x_14)  # -> Geometry, Transform
rotate_3d_18 = Rotate3D(Geometry=domain_box_13, Angle=degrees("90"), Center=Point(0, 0, 0), Axis=unit_z_4)  # -> Geometry, Transform
unit_x_15 = UnitX(Factor=1)
unit_y_16 = UnitY(Factor=1)
unit_y_17 = UnitY(Factor=1)
unit_y_18 = UnitY(Factor=1)
unit_y_19 = UnitY(Factor=1)
unit_y_20 = UnitY(Factor=1)
rotate_3d_19 = Rotate3D(Geometry=rotate_3d_13.Geometry, Angle=degrees("90"), Center=Point(0, 0, 0), Axis=unit_x_15)  # -> ParalAtravesado, Transform
rotate_3d_20 = Rotate3D(Geometry=rotate_3d_14.Geometry, Angle=degrees("90"), Center=Point(0, 0, 0), Axis=unit_y_16)  # -> Geometry, Transform
rotate_3d_21 = Rotate3D(Geometry=rotate_3d_15.Geometry, Angle=degrees("0"), Center=Point(0, 0, 0), Axis=unit_y_17)  # -> Geometry, Transform
rotate_3d_22 = Rotate3D(Geometry=rotate_3d_16.Geometry, Angle=degrees("90"), Center=Point(0, 0, 0), Axis=unit_y_18)  # -> Geometry, Transform
rotate_3d_23 = Rotate3D(Geometry=rotate_3d_17.Geometry, Angle=degrees("0"), Center=Point(0, 0, 0), Axis=unit_y_19)  # -> Geometry, Transform
rotate_3d_24 = Rotate3D(Geometry=rotate_3d_18.Geometry, Angle=degrees("0"), Center=Point(0, 0, 0), Axis=unit_y_20)  # -> CubiertaAtravesada, Transform
stream_filter_23 = StreamFilter(
    Gate=rh_in_03_0_mapeado,
    Stream0=rotate_3d_20.Geometry,
    Stream1=rotate_3d_19.ParalAtravesado,
    Stream2=rotate_3d_21.Geometry,
    Stream3=rotate_3d_22.Geometry,
    Stream4=rotate_3d_23.Geometry,
    Stream5=rotate_3d_24.CubiertaAtravesada)

python_3_script = Python3Script(M=mesh_join_3, B=stream_filter_22)  # -> a; inputs M: Mesh, B: Box
# ---------- python_3_script: Python ----------
import Rhino

def aplicar_mapeado_caja(mesh, box_input):
    if mesh is None:
        return None
    
    mesh_mapped = mesh.DuplicateMesh()
    
    if box_input is not None:
        box_geom = None
        if isinstance(box_input, Rhino.Geometry.Box):
            box_geom = box_input
        elif hasattr(box_input, "GetBoundingBox"):
            bbox = box_input.GetBoundingBox(True)
            box_geom = Rhino.Geometry.Box(bbox)
            
        if box_geom is not None and box_geom.IsValid:
            plane = box_geom.Plane
            size_x = max(1.0, box_geom.X.Length)
            size_y = max(1.0, box_geom.Y.Length)
            size_z = max(1.0, box_geom.Z.Length)
            center = box_geom.Center
            
            # Asegurar normales de vértices calculadas
            mesh_mapped.Normals.ComputeNormals()
            mesh_mapped.TextureCoordinates.Clear()
            
            # Mapeo Cúbico 3D de 6 Caras Independientes (BoxMapping Real)
            for idx in range(len(mesh_mapped.Vertices)):
                v = mesh_mapped.Vertices[idx]
                n = mesh_mapped.Normals[idx] if idx < len(mesh_mapped.Normals) else Rhino.Geometry.Vector3f(0, 0, 1)
                
                # Posición y normal en el espacio local de la caja
                pt = Rhino.Geometry.Point3d(v)
                vec = pt - center
                local_x = vec * plane.XAxis
                local_y = vec * plane.YAxis
                local_z = vec * plane.ZAxis
                
                norm_vec = Rhino.Geometry.Vector3d(n)
                norm_x = abs(norm_vec * plane.XAxis)
                norm_y = abs(norm_vec * plane.YAxis)
                norm_z = abs(norm_vec * plane.ZAxis)
                
                # Proyección según la cara dominante de la caja
                if norm_z >= norm_x and norm_z >= norm_y:
                    # Caras Superior / Inferior
                    u = (local_x / size_x) + 0.5
                    v_coord = (local_y / size_y) + 0.5
                elif norm_y >= norm_x and norm_y >= norm_z:
                    # Cantos Frontal / Trasero
                    u = (local_x / size_x) + 0.5
                    v_coord = (local_z / size_z) + 0.5
                else:
                    # Cantos Lateral Izquierdo / Derecho
                    u = (local_y / size_y) + 0.5
                    v_coord = (local_z / size_z) + 0.5
                    
                mesh_mapped.TextureCoordinates.Add(float(u), float(v_coord))
                
    return mesh_mapped

# Procesar entradas
if isinstance(M, list):
    resultado = [aplicar_mapeado_caja(item, B) for item in M if item is not None]
else:
    resultado = aplicar_mapeado_caja(M, B)

a = resultado
# ---------- end python_3_script ----------
python_3_script_2 = Python3Script(M=mesh_join_4, B=stream_filter_22)  # -> a; inputs M: Mesh, B: Box; same code as python_3_script
python_3_script_3 = Python3Script(M=mesh_join_2, B=stream_filter_22)  # -> a; inputs M: Mesh, B: Box; same code as python_3_script
python_3_script_4 = Python3Script(M=mesh_join_5, B=stream_filter_23)  # -> a; inputs M: Mesh, B: Box; same code as python_3_script
rh_out_color_entrepaño = Geometry(python_3_script)
python_3_script_5 = Python3Script(M=mesh_join_6, B=stream_filter_23)  # -> a; inputs M: Mesh, B: Box; same code as python_3_script
rh_out_balance_entrepaño = Geometry(python_3_script_2)
python_3_script_6 = Python3Script(M=mesh_join_7, B=stream_filter_23)  # -> a; inputs M: Mesh, B: Box; same code as python_3_script
rh_out_mdp_entrepaño = Geometry(python_3_script_3)
rh_out_color_cubierta = Geometry(python_3_script_4)
rh_out_balance_cubierta = Geometry(python_3_script_6)
rh_out_mdp = Geometry(python_3_script_5)
